# Grasshopper definition FacadeEmbed_JinQiao_Podium.gh (Grasshopper 1.0.7)
# plug-ins: EleFront, Wombat, Pufferfish, TT Toolbox, Hare, treesloth01

# ----
# 线段延长长度
number_slider = Slider(1001, range=0..10000)  # disabled

# ----
# remove duplicate curves
geo = Geometry()  # disabled
number_slider_2 = Slider(0.1, range=0..0.1)  # disabled
boundary = BoundarySurfaces(Edges=geo)  # disabled
area = Area(Geometry=boundary)  # -> Area, Centroid; disabled
cullduppoints = RemoveDuplicatePoints(InputPoints=area.Centroid, Tolerance=number_slider_2)  # -> OutputPoints, FirstPointIndexes; disabled
null = NullItem(Item=cullduppoints.FirstPointIndexes)  # -> NullFlags, InvalidFlags, Description; disabled
dispatch = Dispatch(List=boundary, DispatchPattern=null.NullFlags)  # -> ListA, ListB; disabled
geo_2 = Geometry(dispatch.ListA)  # disabled

# ----
# 调换阴阳角设定
toggle = BooleanToggle(False)  # disabled

# ----
# （1）导入埋件定位点
# Block & Curve的形式
# block names
listblockd = ListBlockDocument()
panel = Panel(listblockd)

# ----
# Input Blocks (Correct Plan)
# 主体定位点
data = Data(["PX-GLAZ-F2$0$PX-GLAZ-F1$0$标准块", "PX-GLAZ-F2$0$PX-GLAZ-F2$0$标准块", "PX-GLAZ-F2$0$PX-GLAZ-F3$0$标准块"])

# ----
# Input Curves
# 主体定位点（按图层导入）
crv = Curve(<curve referenced from the Rhino model>)

# ----
# Input Blocks (Wrong Plan)
# 主体定位点
data_2 = Data("PX-GLAZ-F2$0$T3T")

# ----
# 1.输入block names
data_3 = Data(["PX-GLAZ-F2$0$PX-GLAZ-F2$0$fin", "PX-GLAZ-F2$0$PX-GLAZ-F1$0$fin"])
panel_2 = Panel(data_3)

# ----
# （0）Prep
# 检测Block的Plane
# block names
listblockd_2 = ListBlockDocument()
panel_4 = Panel(listblockd_2)
refblock = ReferenceBlockByName(BlockName=panel_2)
deblock = DeconstructBlock(Block=refblock)  # -> Name, Plane, Geometry

# ----
# 按图层整理curves
# 2.Line-0-建筑
# 3.Line-1-结构
panel_5 = Panel("Line-0-建筑-Whole")
reflay = ReferenceByLayer(LayerName=panel_5)
reflay_2 = ReferenceByLayer(LayerName="Line-1-檐口")
reflay_3 = ReferenceByLayer(LayerName="Line-1-结构-Out")
reflay_4 = ReferenceByLayer(LayerName="Line-1-结构-All")

# ----
# Later:
# 1.Block -Plane-不同方向合并处理
# 
# 2.双层幕墙的处理
# 按图层整理curves
# 1.Line-1-建筑-
panel_6 = Panel("Line-1-建筑-SmoothCurve")
reflay_5 = ReferenceByLayer(LayerName=panel_6)
reflay_6 = ReferenceByLayer(LayerName="Line-1-建筑-Curve_withLocation")
reflay_7 = ReferenceByLayer(LayerName="Line-1-建筑-Curve-hasAngle")
reflay_8 = ReferenceByLayer(LayerName="Line-1-建筑-Whole")

# ----
# This Project Only
panel_7 = Panel("Line-1-建筑-SpecialCurve")
reflay_9 = ReferenceByLayer(LayerName=panel_7)

# ----
# 单体选型
list = ValueList({"板埋": 0, "槽埋": 1, "板槽埋": 2}, selected="槽埋")
list_2 = ValueList({"顶埋": 0, "侧埋": 1}, selected="顶埋")
panel_8 = Panel(list)
panel_9 = Panel(list_2)

# ----
# 第一层
layer = ObjectLayer(Guid=crv)  # -> LayerIndex, LayerPathName
panel_10 = Panel(data)
panel_12 = Panel(data_2)
panel_13 = Panel(layer.LayerPathName)
refblock_2 = ReferenceBlockByName(BlockName=panel_10)
reflay_10 = ReferenceByLayer(LayerName=panel_13)
refblock_3 = ReferenceBlockByName(BlockName=panel_12)
xy = XYPlane(Origin=Point(0, 0, 0))
xy_2 = XYPlane(Origin=Point(0, 0, 0))
xy_3 = XYPlane(Origin=Point(0, 0, 0))
project = Project(Geometry=refblock_2, Plane=xy_2)  # -> Geometry, Transform
project_2 = Project(Geometry=reflay_10, Plane=xy)  # -> Geometry, Transform
project_3 = Project(Geometry=refblock_3, Plane=xy_3)  # -> Geometry, Transform

# ---- group: 结构线
crv_2 = Curve(<curve referenced from the Rhino model>)

# ----
# 平面定位INPUT
crv_3 = Curve([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])

# ---- group: 玻璃线
玻璃线 = Curve(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)
玻璃线_2 = Curve(<curve referenced from the Rhino model>)
玻璃线_3 = Curve(<curve referenced from the Rhino model>)

# ---- group: 定位竖料
crv_4 = Curve([<curve referenced from the Rhino model> x300])
crv_5 = Curve([<curve referenced from the Rhino model> x180])
crv_6 = Curve([<curve referenced from the Rhino model> x383])

# ---- group: 混凝土
# 板埋几何INPUT
list_3 = ValueList({"C15": 0, "C20": 1, "C25": 2, "C30": 3, "C35": 4, "C40": 5}, selected="C35")

# ---- group: 钢筋牌号
list_4 = ValueList({"HPB300": 0, "HRB400": 1}, selected="HPB300")

# ---- group: 直径
list_5 = ValueList({"10": 0, "12": 1, "16": 2, "18": 3, "20": 4, "25": 5}, selected="12")

# ---- group: 列
list_6 = ValueList({"2X": 0, "3X": 1, "4X": 2}, selected="3X")

# ---- group: 行
list_7 = ValueList({"2Y": 0, "3Y": 1, "4Y": 2}, selected="2Y")

# ---- group: 锚筋间距
s_x = Slider(22, range=14..60, expression="X*5")
s_y = Slider(22, range=14..60, expression="X*5")

# ----
crv_7 = Curve([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])

# ----
# （2）导入参考线
# 按照图层导入建筑、结构、檐口线
xy_4 = XYPlane(Origin=Point(0, 0, 0))
xy_5 = XYPlane(Origin=Point(0, 0, 0))
xy_6 = XYPlane(Origin=Point(0, 0, 0))
xy_7 = XYPlane(Origin=Point(0, 0, 0))
xy_8 = XYPlane(Origin=Point(0, 0, 0))
xy_9 = XYPlane(Origin=Point(0, 0, 0))
xy_10 = XYPlane(Origin=Point(0, 0, 0))
xy_11 = XYPlane(Origin=Point(0, 0, 0))
xy_12 = XYPlane(Origin=Point(0, 0, 0))
project_4 = Project(Geometry=reflay_5, Plane=xy_4)  # -> Geometry, Transform
project_5 = Project(Geometry=reflay_6, Plane=xy_5)  # -> Geometry, Transform
project_6 = Project(Geometry=reflay_7, Plane=xy_6)  # -> Geometry, Transform
project_7 = Project(Geometry=reflay_8, Plane=xy_7)  # -> Geometry, Transform
project_8 = Project(Geometry=reflay_9, Plane=xy_8)  # -> Geometry, Transform
project_9 = Project(Geometry=reflay_3, Plane=xy_10)  # -> Geometry, Transform
project_10 = Project(Geometry=reflay, Plane=xy_11)  # -> Geometry, Transform
project_11 = Project(Geometry=reflay_2, Plane=xy_9)  # -> Geometry, Transform
project_12 = Project(Geometry=reflay_4, Plane=xy_12)  # -> Geometry, Transform
crv_8 = Curve(project_5.Geometry)
crv_9 = Curve(project_4.Geometry)
crv_10 = Curve(project_6.Geometry)
crv_11 = Curve(project_7.Geometry)
crv_12 = Curve(project_9.Geometry)
crv_13 = Curve(project_12.Geometry)
crv_14 = Curve(project_10.Geometry)
crv_15 = Curve(project_11.Geometry)

# ----
# 2.检测plane是否存在
pln = Plane(deblock.Plane)

# ----
# 槽埋-角部选择
list_8 = ValueList({"槽埋角部-L形": 0, "槽埋角部-I形": 1}, selected="槽埋角部-I形")

join = JoinCurves(Curves=crv_7, Preserve=False)
crv_16 = Curve(<curve referenced from the Rhino model>)

# ----
# 3.如果不存在则Blake geometry
# 并在rhino里面清理线段
geo_3 = Geometry(deblock.Geometry)

flip = FlipCurve(Curve=玻璃线)  # -> Curve, Flag
boundary_2 = BoundarySurfaces(Edges=join)
filter = StreamFilter(Gate=Toggle(True), Stream0=玻璃线, Stream1=flip.Curve)
sunion = SolidUnion(Breps=boundary_2)
offset = OffsetCurve(Curve=filter, Distance=expr("-x", Slider(375, range=0..1000)), Corners=1)
area_2 = Area(Geometry=sunion)  # -> Area, Centroid
pt = Point(area_2.Centroid)
explode = Explode(Curve=offset, Recursive=True)  # -> Segments, Vertices
pt_2 = Point(explode.Vertices)
entwine = Entwine(Branch00=sunion, Branch01=pt, FlattenInputs=True)
max = Maximum(A=s_x, B=s_y)
flip_2 = FlipMatrix(Data=entwine)
filter_2 = StreamFilter(Gate=list_3, Stream0=7.2, Stream1=9.6, Stream2=11.9, Stream3=14.3, Stream4=16.7, Stream5=19.1)
filter_3 = StreamFilter(Gate=list_4, Stream0=270, Stream1=360)
filter_4 = StreamFilter(Gate=list_5, Stream0=10, Stream1=12, Stream2=16, Stream3=18, Stream4=20, Stream5=25)
filter_5 = StreamFilter(Gate=list_3, Stream0=0.91, Stream1=1.1, Stream2=1.27, Stream3=1.43, Stream4=1.57, Stream5=1.71)
filter_6 = StreamFilter(Gate=list_4, Stream0=0.16, Stream1=0.14)
addition = Addition(A=list_6, B=1)
addition_2 = Addition(A=list_7, B=1)
division = Division(A=max, B=8)
crv_17 = Curve(crv_11)
crv_18 = Curve(crv_13)
crv_19 = Curve(crv_14)

# ----
# 测试Smooth Curve是否与每个Block相切
# remove duplicate blocks
deblock_2 = DeconstructBlock(Block=project.Geometry)  # -> Name, Plane, Geometry
pln_2 = Plane(flatten(deblock_2.Plane))
deplane = DeconstructPlane(Plane=pln_2)  # -> Origin, XAxis, YAxis, ZAxis
cullduppoints_2 = RemoveDuplicatePoints(InputPoints=deplane.Origin, Tolerance=0.001)  # -> OutputPoints, FirstPointIndexes
null_2 = NullItem(Item=cullduppoints_2.FirstPointIndexes)  # -> NullFlags, InvalidFlags, Description
dispatch_2 = Dispatch(List=pln_2, DispatchPattern=null_2.InvalidFlags)  # -> ListA, ListB
dispatch_3 = Dispatch(List=flatten(project.Geometry), DispatchPattern=null_2.InvalidFlags)  # -> ListA, ListB
pln_3 = Plane(dispatch_2.ListA)

# ----
# 测试Smooth Curve是否与每个Block相切
# remove duplicate blocks
deblock_3 = DeconstructBlock(Block=project_3.Geometry)  # -> Name, Plane, Geometry
pln_4 = Plane(flatten(deblock_3.Plane))
deplane_2 = DeconstructPlane(Plane=pln_4)  # -> Origin, XAxis, YAxis, ZAxis
cullduppoints_3 = RemoveDuplicatePoints(InputPoints=deplane_2.Origin, Tolerance=0.001)  # -> OutputPoints, FirstPointIndexes
null_3 = NullItem(Item=cullduppoints_3.FirstPointIndexes)  # -> NullFlags, InvalidFlags, Description
dispatch_4 = Dispatch(List=pln_4, DispatchPattern=null_3.InvalidFlags)  # -> ListA, ListB
dispatch_5 = Dispatch(List=flatten(project_3.Geometry), DispatchPattern=null_3.InvalidFlags)  # -> ListA, ListB
pln_5 = Plane(dispatch_4.ListA)

# ---- group: 建筑定位轮廓
item = ListItem(List=flip_2, Index="0", Wrap=True)  # -> flatten(Item)

# ---- group: 埋件定位点
item_2 = ListItem(List=flip_2, Index="-1", Wrap=True)  # -> flatten(Item)

# ----
t = Integer(division)
panel_14 = Panel(filter_5)
panel_15 = Panel(filter_2)
panel_16 = Panel(filter_6)
min = Minimum(A=filter_3, B=300)
panel_17 = Panel(min)

deblock_4 = DeconstructBlock(Block=dispatch_3.ListA)  # -> Name, Plane, Geometry
data_4 = Data(dispatch_3.ListA)

deblock_5 = DeconstructBlock(Block=dispatch_5.ListA)  # -> Name, Plane, Geometry
data_5 = Data(dispatch_5.ListA)

data_6 = Data(flatten(pln_3))
deplane_3 = DeconstructPlane(Plane=data_6)  # -> Origin, XAxis, YAxis, ZAxis
pln_6 = Plane(data_6)
amp = Amplitude(Vector=deplane_3.YAxis, Amplitude=Slider(300, range=0..1000))
move = Move(Geometry=deplane_3.Origin, Motion=amp)  # -> Geometry, Transform
ln = Line(StartPoint=deplane_3.Origin, EndPoint=move.Geometry)
crv_20 = Curve(crv_9)
midpt = CurveMiddle(Curve=ln)
scale = Scale(Geometry=ln, Center=midpt, Factor=Slider(7.8, range=0..10))  # -> Geometry, Transform
merge = Merge(Data1=scale.Geometry, Data2=crv_20)
mcx = MultipleCurves(Curves=flatten(merge))  # -> Points, IndexA, IndexB, ParamA, ParamB

data_7 = Data(flatten(pln_5))
deplane_4 = DeconstructPlane(Plane=data_7)  # -> Origin, XAxis, YAxis, ZAxis
pln_7 = Plane(data_7)
amp_2 = Amplitude(Vector=deplane_4.YAxis, Amplitude=Slider(300, range=0..1000))
move_2 = Move(Geometry=deplane_4.Origin, Motion=amp_2)  # -> Geometry, Transform
ln_2 = Line(StartPoint=deplane_4.Origin, EndPoint=move_2.Geometry)
crv_21 = Curve(crv_9)
midpt_2 = CurveMiddle(Curve=ln_2)
scale_2 = Scale(Geometry=ln_2, Center=midpt_2, Factor=Slider(7.8, range=0..10))  # -> Geometry, Transform
merge_2 = Merge(Data1=scale_2.Geometry, Data2=crv_21)
mcx_2 = MultipleCurves(Curves=flatten(merge_2))  # -> Points, IndexA, IndexB, ParamA, ParamB

expression = Expression(A=filter_6, fy=filter_3, ft=filter_5, d=filter_4, Expression="(int((0.6*1.1*A*fy/ft*d)/5)+1)*5")

# ----
# 导入槽埋模型
brep = Brep(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)

# ---- group: 槽埋
# 槽埋Modeling
brep_2 = Brep(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)
bbox = BoundingBox(Content=brep, Plane=PlaneXY(0, 0, 0))  # -> Box, Box_2
debox = DeconstructBox(Box=bbox.Box)  # -> Plane, X, Y, Z
area_3 = Area(Geometry=brep)  # -> Area, Centroid
pdecon = Deconstruct(Point=area_3.Centroid)  # -> XComponent, YComponent, ZComponent
dedomain = DeconstructDomain(Domain=debox.Z)  # -> Start, End
xy_13 = XYPlane(Origin=Point(0, 0, 0))
pt_3 = ConstructPoint(XCoordinate=pdecon.XComponent, YCoordinate=pdecon.YComponent, ZCoordinate=dedomain.End)
pl_origin = PlaneOrigin(Base=xy_13, Origin=pt_3)
xy_14 = XYPlane(Origin=Point(0, 0, 0))
orient = Orient(Geometry=brep, Source=pl_origin, Target=xy_14)  # -> Geometry, Transform

# ----
# blocks + special curves
cull_i = CullIndex(List=flatten(pln_6), Indices=mcx.IndexA, Wrap=True)
cull_i_2 = CullIndex(List=flatten(data_4), Indices=mcx.IndexA, Wrap=True)
pln_8 = Plane(cull_i)
data_8 = Data(cull_i_2)

# ----
# blocks + special curves
cull_i_3 = CullIndex(List=flatten(pln_7), Indices=mcx_2.IndexA, Wrap=True)
cull_i_4 = CullIndex(List=flatten(data_5), Indices=mcx_2.IndexA, Wrap=True)
pln_9 = Plane(cull_i_3)
data_9 = Data(cull_i_4)

# ----
# blocks + smooth curves
item_3 = ListItem(List=pln_6, Index=mcx.IndexA, Wrap=True)
item_4 = ListItem(List=flatten(data_4), Index=mcx.IndexA, Wrap=True)
data_10 = Data(item_4)
pln_10 = Plane(item_3)

# ----
# blocks + smooth curves
item_5 = ListItem(List=pln_7, Index=mcx_2.IndexA, Wrap=True)
item_6 = ListItem(List=flatten(data_5), Index=mcx_2.IndexA, Wrap=True)
data_11 = Data(item_6)
pln_11 = Plane(item_5)

edges = BrepEdges(Brep=bbox.Box)  # -> Naked, Interior, NonManifold
item_7 = ListItem(List=edges.Interior, Index="5", Wrap=True)
item_8 = ListItem(List=edges.Interior, Index="4", Wrap=True)
clx = CurveLine(Curve=item_8, Line=item_7)  # -> Points, Params, Count
Y = UnitY(Factor=item_7)
rotate = Rotate(Geometry=brep, Angle=1.570796327, Plane=clx.Points)  # -> Geometry, Transform
move_3 = Move(Geometry=rotate.Geometry, Motion=Y)  # -> Geometry, Transform
merge_3 = Merge(Data1=brep, Data2=move_3.Geometry)  # -> flatten(Result)
sunion_2 = SolidUnion(Breps=merge_3)
bbox_2 = BoundingBox(Content=sunion_2, Plane=PlaneXY(0, 0, 0))  # -> Box, Box_2
area_4 = Area(Geometry=sunion_2)  # -> Area, Centroid
debox_2 = DeconstructBox(Box=bbox_2.Box)  # -> Plane, X, Y, Z
pdecon_2 = Deconstruct(Point=area_4.Centroid)  # -> XComponent, YComponent, ZComponent
dedomain_2 = DeconstructDomain(Domain=debox_2.Z)  # -> Start, End
pt_4 = ConstructPoint(XCoordinate=pdecon_2.XComponent, YCoordinate=pdecon_2.YComponent, ZCoordinate=dedomain_2.End)
xy_15 = XYPlane(Origin=Point(0, 0, 0))
pl_origin_2 = PlaneOrigin(Base=xy_15, Origin=pt_4)
xy_16 = XYPlane(Origin=Point(0, 0, 0))
orient_2 = Orient(Geometry=sunion_2, Source=pl_origin_2, Target=xy_16)  # -> Geometry, Transform

# ----
# remove duplicate curves
geo_4 = Geometry(project_2.Geometry)
boundary_3 = BoundarySurfaces(Edges=geo_4)
area_5 = Area(Geometry=boundary_3)  # -> Area, Centroid
cullduppoints_4 = RemoveDuplicatePoints(InputPoints=area_5.Centroid, Tolerance=Slider(0.1, range=0..0.1))  # -> OutputPoints, FirstPointIndexes
null_4 = NullItem(Item=cullduppoints_4.FirstPointIndexes)  # -> NullFlags, InvalidFlags, Description
dispatch_6 = Dispatch(List=boundary_3, DispatchPattern=null_4.NullFlags)  # -> ListA, ListB
geo_5 = Geometry(dispatch_6.ListA)

# ----
# 第一层
# 
# Special Curves(architecture line)
crv_22 = Curve(crv_8)
pln_12 = Plane(pln_8)
deplane_5 = DeconstructPlane(Plane=pln_12)  # -> Origin, XAxis, YAxis, ZAxis
disc = Discontinuity(Curve=crv_22, Level=1)  # -> Points, Parameters
pull = PullPoint(Point=deplane_5.Origin, Geometry=disc.Points, ClosestOnly=True)  # -> ClosestPoint, Distance
sort = SortList(Keys=pull.Distance)  # -> reverse(Keys), ValuesA
panel_18 = Panel(sort.Keys)
larger = LargerThan(FirstNumber=pull.Distance, SecondNumber=Slider(300, range=0..1000))  # -> LargerThan, OrEqualTo
dispatch_7 = Dispatch(List=pln_12, DispatchPattern=larger.LargerThan)  # -> ListA, ListB
data_12 = Data(dispatch_7.ListB)
deplane_6 = DeconstructPlane(Plane=data_12)  # -> Origin, XAxis, YAxis, ZAxis
pull_2 = PullPoint(Point=deplane_6.Origin, Geometry=disc.Points, ClosestOnly=True)  # -> ClosestPoint, Distance

# ----
# 导入槽埋模型
brep_3 = Brep(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)

filter_7 = StreamFilter(Gate=list_8, Stream0=orient_2.Geometry, Stream1=orient.Geometry)
entwine_2 = Entwine(Branch00=orient.Geometry, Branch01=filter_7, FlattenInputs=True)
crv_23 = Curve(offset)

# ----
# Special Curve(with location)- All
pl = ConstructPlane(Origin=pull_2.ClosestPoint, XAxis=deplane_6.XAxis, YAxis=deplane_6.YAxis)

crv_24 = Curve([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])
crv_25 = Curve(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)
merge_4 = Merge(Data1=crv_24, Data2=crv_25)
crv_26 = Curve(crv_12)

disc_2 = Discontinuity(Curve=crv_26, Level=1)  # -> flatten(Points), Parameters
graft = GraftTree(Tree=disc_2.Points, IncludeEmptyLists=True, IncludeNullItems=True)
ln_3 = Line(StartPoint=disc_2.Points, EndPoint=graft)
len = Length(Curve=ln_3)
sort_2 = SortList(Keys=len, ValuesA=ln_3)  # -> Keys, ValuesA
item_9 = ListItem(List=sort_2.ValuesA, Index="1", Wrap=True)  # -> flatten(Item)
len_2 = Length(Curve=item_9)
larger_2 = LargerThan(FirstNumber=len_2, SecondNumber=Slider(500, range=0..1000))  # -> LargerThan, OrEqualTo
dispatch_8 = Dispatch(List=item_9, DispatchPattern=larger_2.LargerThan)  # -> ListA, ListB

# ----
# Join Curves
line = Line(dispatch_8.ListB)

# ----
# 根据F2建筑线制作轮廓线
crv_27 = Curve(crv_17)
explode_2 = Explode(Curve=crv_27, Recursive=True)  # -> Segments, Vertices
len_3 = Length(Curve=explode_2.Segments)
number_slider_3 = Slider(50, range=0..100)
sort_3 = SortList(Keys=len_3)  # -> Keys, ValuesA
number_slider_4 = Slider(945, range=0..1000)
panel_19 = Panel(sort_3.Keys)
larger_3 = LargerThan(FirstNumber=len_3, SecondNumber=Slider(1200, range=0..10000))  # -> LargerThan, OrEqualTo
dispatch_9 = Dispatch(List=explode_2.Segments, DispatchPattern=larger_3.LargerThan)  # -> ListA, ListB
data_13 = Data(dispatch_9.ListB)
data_14 = Data(dispatch_9.ListA)
join_2 = JoinCurves(Curves=data_13, Preserve=False)
number_slider_5 = Slider(10, range=0..10)
disc_3 = Discontinuity(Curve=join_2, Level=1)  # -> Points, Parameters
nurbs = NurbsCurve(Vertices=disc_3.Points, Degree=Slider(11, range=0..11), Periodic=False)  # -> flatten(Curve), Length, Domain
join_3 = JoinCurves(Curves=flatten([data_14, nurbs.Curve]), Preserve=False)
offset_2 = OffsetCurve(Curve=join_3, Distance=Slider(6859, range=0..10000), Corners=1)

# ----
# 半手动??
reb = RebuildCurve(Curve=offset_2, Count=Slider(17, range=0..100), Tangents=invert(False))

# ----
# 梁宽根据tag
number_slider_6 = Slider(150, range=0..1000)

# ----
# 区分内外梁边线
crv_28 = Curve(crv_13)
offcrv = OffsetCurve(
    Curve=crv_28,
    Plane=PlaneXY(0, 0, 0),
    Distance=number_slider_6,
    BothSides=expr("-x", number_slider_6),
    Kinks=0,
    CapType="0")
crv_29 = Curve(reb)
midpt_3 = CurveMiddle(Curve=offcrv)
midpt_4 = CurveMiddle(Curve=crv_28)
crv_30 = Curve(offcrv)
item_10 = ListItem(List=midpt_3, Index=0, Wrap=True)
item_11 = ListItem(List=crv_30, Index=0, Wrap=True)
item_12 = ListItem(List=crv_30, Index="-1", Wrap=True)
pull_3 = PullPoint(Point=midpt_4, Geometry=crv_29, ClosestOnly=True)  # -> ClosestPoint, Distance
ln_4 = Line(StartPoint=item_10, EndPoint=graft(pull_3.ClosestPoint))
graft_2 = GraftTree(Tree=crv_28, IncludeEmptyLists=True, IncludeNullItems=True)
ccx = CurveCurve(CurveA=ln_4, CurveB=graft_2)  # -> Points, ParamsA, ParamsB
null_5 = NullItem(Item=ccx.Points)  # -> NullFlags, InvalidFlags, Description
dispatch_10 = Dispatch(List=item_12, DispatchPattern=null_5.InvalidFlags)  # -> ListA, ListB
dispatch_11 = Dispatch(List=item_11, DispatchPattern=null_5.InvalidFlags)  # -> ListA, ListB

# ----
# 梁边线-外
merge_5 = Merge(Data1=dispatch_11.ListA, Data2=dispatch_10.ListB)

# ----
# 梁边线-内
merge_6 = Merge(Data1=dispatch_11.ListB, Data2=dispatch_10.ListA)

# ----
# Sort Text
panel_20 = Panel("""T2-PLAN-F2$0$次梁编号
T2-PLAN-F2$0$框梁编号""")
reflay_11 = ReferenceByLayer(LayerName=panel_20)  # -> flatten(Geometry)
panel_21 = Panel("""GL3-1
GL4-1
GL5-1
GL5-2
GL6-1
GL6-2
GKL6-2
GL7-1
GL7-2
GKL7-1
GL8-1
GL8-2
GKl7-1
GKl7-4
GKL9-2
GL10-1
GL10-4
GKL10-2
GKL10-4
GL12-1""")
detext = DeconstructText(TextObject=reflay_11)  # -> Text, Plane, Height, Justification
lng = ListLength(List=detext.Text)
tmatch = MatchText(Text=detext.Text, Pattern=graft(panel_21), Case=True)
tsort = SortText(Keys=detext.Text, Culture=127)  # -> Keys, Values
pt_5 = Point(detext.Plane)
dispatch_12 = Dispatch(List=reflay_11, DispatchPattern=tmatch)  # -> ListA, ListB
panel_22 = Panel(lng)
panel_23 = Panel(tsort.Keys)
data_15 = Data(dispatch_12.ListA)
bang = ExplodeTree(Data=data_15)  # -> Branch0, Branch1, Branch2, Branch3, Branch4, Branch5, Branch6, Branch7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
flatten = FlattenTree(Tree=data_15, Path="{0}")
lng_2 = ListLength(List=flatten)
equals = Equality(FirstNumber=panel_22, SecondNumber=lng_2)  # -> Equality, Inequality
filter_8 = StreamFilter(Gate=equals.Equality, Stream0="Missing Text!", Stream1="Correct!")
panel_24 = Panel(filter_8)
detext_2 = DeconstructText(TextObject=bang.Branch0)  # -> Text, Plane, Height, Justification
detext_3 = DeconstructText(TextObject=bang.Branch1)  # -> Text, Plane, Height, Justification
detext_4 = DeconstructText(TextObject=bang.Branch2)  # -> Text, Plane, Height, Justification
detext_5 = DeconstructText(TextObject=bang.Branch3)  # -> Text, Plane, Height, Justification
detext_6 = DeconstructText(TextObject=bang.Branch4)  # -> Text, Plane, Height, Justification
detext_7 = DeconstructText(TextObject=bang.Branch5)  # -> Text, Plane, Height, Justification
detext_8 = DeconstructText(TextObject=bang.Branch6)  # -> Text, Plane, Height, Justification
detext_9 = DeconstructText(TextObject=bang.Branch7)  # -> Text, Plane, Height, Justification
detext_10 = DeconstructText(TextObject=bang.Branch8)  # -> Text, Plane, Height, Justification
detext_11 = DeconstructText(TextObject=bang.Branch9)  # -> Text, Plane, Height, Justification
detext_12 = DeconstructText(TextObject=bang.Branch10)  # -> Text, Plane, Height, Justification
detext_13 = DeconstructText(TextObject=bang.Branch11)  # -> Text, Plane, Height, Justification
detext_14 = DeconstructText(TextObject=bang.Branch12)  # -> Text, Plane, Height, Justification
detext_15 = DeconstructText(TextObject=bang.Branch13)  # -> Text, Plane, Height, Justification
detext_16 = DeconstructText(TextObject=bang.Branch14)  # -> Text, Plane, Height, Justification
detext_17 = DeconstructText(TextObject=bang.Branch15)  # -> Text, Plane, Height, Justification
detext_18 = DeconstructText(TextObject=bang.Branch16)  # -> Text, Plane, Height, Justification
detext_19 = DeconstructText(TextObject=bang.Branch17)  # -> Text, Plane, Height, Justification
detext_20 = DeconstructText(TextObject=bang.Branch18)  # -> Text, Plane, Height, Justification
detext_21 = DeconstructText(TextObject=bang.Branch19)  # -> Text, Plane, Height, Justification
pt_6 = Point(detext_9.Plane)
pt_7 = Point(detext_17.Plane)
pt_8 = Point(detext_18.Plane)
pt_9 = Point(detext_2.Plane)
pt_10 = Point(detext_3.Plane)
pt_11 = Point(detext_4.Plane)
pt_12 = Point(detext_5.Plane)
pt_13 = Point(detext_6.Plane)
pt_14 = Point(detext_7.Plane)
pt_15 = Point(detext_8.Plane)
pt_16 = Point(detext_10.Plane)
pt_17 = Point(detext_11.Plane)
pt_18 = Point(detext_12.Plane)
pt_19 = Point(detext_13.Plane)
pt_20 = Point(detext_14.Plane)
pt_21 = Point(detext_15.Plane)
pt_22 = Point(detext_16.Plane)
pt_23 = Point(detext_19.Plane)
pt_24 = Point(detext_20.Plane)
pt_25 = Point(detext_21.Plane)
merge_7 = Merge(
    Data1=pt_9,
    Data2=pt_10,
    Data3=pt_11,
    Data4=pt_12,
    Data5=pt_13,
    Data6=pt_14,
    Data7=pt_15,
    Data8=pt_6,
    Data9=pt_16,
    Data10=pt_17,
    Data11=pt_18,
    Data12=pt_20,
    Data13=pt_21,
    Data14=pt_22,
    Data15=pt_7,
    Data16=pt_8,
    Data17=pt_23,
    Data18=pt_19,
    Data19=pt_24,
    Data20=pt_25)
flatten_2 = FlattenTree(Tree=merge_7, Path="{0}")

crv_31 = Curve(crv_18)
crv_32 = Curve(crv_19)
offset_3 = OffsetCurve(Curve=crv_32, Distance=expr("-x", Slider(5000, range=0..10000)), Corners=1)
offset_4 = OffsetCurve(Curve=crv_32, Distance=Slider(1000, range=0..1000), Corners=1)
close = CloseCurve(Curve=offset_3, Tolerance=0)
close_2 = CloseCurve(Curve=offset_4, Tolerance=0)
boundary_4 = BoundarySurfaces(Edges=[close_2, close])
scx = SurfaceCurve(Surface=boundary_4, Curve=graft(crv_31))  # -> Curves, Points, UVPoints, Normals, Parameters, Tangents
null_6 = NullItem(Item=scx.Curves)  # -> NullFlags, simplify(InvalidFlags), Description
dispatch_13 = Dispatch(List=simplify(graft(crv_31)), DispatchPattern=null_6.InvalidFlags)  # -> ListA, ListB
data_16 = Data(dispatch_13.ListB)
number_slider_7 = Slider(3000, range=0..10000)
ext = ExtendCurve(Curve=flatten(data_16), Type=0, Start=number_slider_7, End=number_slider_7)  # -> flatten(Curve)
crv_33 = Curve(offset_4)
ccx_2 = CurveCurve(CurveA=ext, CurveB=crv_33)  # -> Points, ParamsA, ParamsB
null_7 = NullItem(Item=ccx_2.Points)  # -> NullFlags, simplify(InvalidFlags), Description
dispatch_14 = Dispatch(List=simplify(graft(data_16)), DispatchPattern=null_7.InvalidFlags)  # -> ListA, ListB
number_slider_8 = Slider(3000, range=0..10000)
data_17 = Data(flatten(dispatch_14.ListA))
ext_2 = ExtendCurve(Curve=flatten(data_17), Type=0, Start=number_slider_8, End=number_slider_8)  # -> flatten(Curve)
crv_34 = Curve(close)
ccx_3 = CurveCurve(CurveA=ext_2, CurveB=crv_34)  # -> Points, ParamsA, ParamsB
null_8 = NullItem(Item=ccx_3.Points)  # -> NullFlags, simplify(InvalidFlags), Description
dispatch_15 = Dispatch(List=simplify(graft(data_17)), DispatchPattern=null_8.InvalidFlags)  # -> ListA, ListB
data_18 = Data(dispatch_15.ListB)
data_19 = Data(dispatch_14.ListB)
crv_35 = Curve(reb)
merge_8 = Merge(Data1=data_19, Data2=data_18)
midpt_5 = CurveMiddle(Curve=merge_8)
end = EndPoints(Curve=merge_8)  # -> Start, End
crv_cp = CurveClosestPoint(Point=midpt_5, Curve=crv_35)  # -> Point, Parameter, Distance
ln_5 = Line(StartPoint=end.Start, EndPoint=end.End)
eval = EvaluateCurve(Curve=crv_35, Parameter=crv_cp.Parameter)  # -> Point, Tangent, Angle
angle = Angle(VectorA=flatten(eval.Tangent), VectorB=flatten(ln_5))  # -> Angle, Reflex
deg = Degrees(Radians=angle.Angle)
larger_4 = LargerThan(FirstNumber=deg, SecondNumber=Slider(55, range=0..100))  # -> LargerThan, OrEqualTo
dispatch_16 = Dispatch(List=flatten(merge_8), DispatchPattern=larger_4.LargerThan)  # -> ListA, ListB
dispatch_17 = Dispatch(List=flatten(deg), DispatchPattern=larger_4.LargerThan)  # -> ListA, ListB
data_20 = Data(dispatch_16.ListA)
data_21 = Data(dispatch_17.ListA)
panel_25 = Panel(deg)
smaller = SmallerThan(FirstNumber=data_21, SecondNumber=Slider(153, range=0..1000))  # -> SmallerThan, OrEqualTo
dispatch_18 = Dispatch(List=data_20, DispatchPattern=smaller.SmallerThan)  # -> ListA, ListB
data_22 = Data(dispatch_18.ListB)
data_23 = Data(dispatch_16.ListB)
data_24 = Data(dispatch_15.ListA)
merge_9 = Merge(Data1=data_22, Data2=data_23, Data3=data_24)  # -> flatten(Result)
list_9 = ValueList({"Default Curve": 0, "Input Curve": 1}, selected="Default Curve")
crv_36 = Curve()
data_25 = Data(dispatch_18.ListA)
filter_9 = StreamFilter(Gate=list_9, Stream0=merge_9, Stream1=crv_36)

# ----
# 1/2梁宽
# 给多少？？
number_slider_9 = Slider(150, range=0..1000)

# ----
# 下层幕墙边线在结构边梁以内>350
# （最外层结构线）
number_slider_10 = Slider(350, range=0..1000)

# ----
# 1.2是否有吊顶
crv_37 = Curve(crv_26)
crv_38 = Curve(crv_16)
offset_5 = OffsetCurve(Curve=crv_37, Distance=expr("-x", number_slider_9), Corners=1)
offset_6 = OffsetCurve(Curve=crv_37, Distance=number_slider_9, Corners=1)
midpt_6 = CurveMiddle(Curve=offset_6)
midpt_7 = CurveMiddle(Curve=flatten(offset_5))
midpt_8 = CurveMiddle(Curve=flatten(crv_37))
pull_4 = PullPoint(Point=midpt_8, Geometry=crv_38, ClosestOnly=True)  # -> ClosestPoint, Distance
pull_5 = PullPoint(Point=midpt_8, Geometry=flatten(midpt_6), ClosestOnly=True)  # -> ClosestPoint, Distance
pull_6 = PullPoint(Point=midpt_8, Geometry=flatten(midpt_7), ClosestOnly=True)  # -> ClosestPoint, Distance
ln_6 = Line(StartPoint=pull_4.ClosestPoint, EndPoint=pull_5.ClosestPoint)
ln_7 = Line(StartPoint=pull_4.ClosestPoint, EndPoint=pull_6.ClosestPoint)
ccx_4 = CurveCurve(CurveA=graft(ln_6), CurveB=crv_37)  # -> Points, ParamsA, ParamsB
pshift = ShiftPaths(Data=ccx_4.Points, Offset=-1)
null_9 = NullItem(Item=pshift)  # -> NullFlags, flatten(InvalidFlags), Description
dispatch_19 = Dispatch(List=crv_37, DispatchPattern=null_9.InvalidFlags)  # -> ListA, ListB
data_26 = Data(dispatch_19.ListA)
data_27 = Data(dispatch_19.ListB)
addition_3 = Addition(A=number_slider_9, B=number_slider_10)
offset_7 = OffsetCurve(Curve=data_26, Distance=expr("-x", addition_3), Corners=1)
offset_8 = OffsetCurve(Curve=data_27, Distance=addition_3, Corners=1)

# ----
# 内测梁边线
merge_10 = Merge(Data1=offset_7, Data2=offset_8)

crv_39 = Curve(crv_14)

# ----
# 2.1下层建筑边线外侧50-350mm范围内
number_slider_11 = Slider(50, range=0..100)
crv_40 = Curve(crv_39)
offset_9 = OffsetCurve(Curve=crv_40, Distance=number_slider_11, Corners=1)
offset_10 = OffsetCurve(Curve=crv_40, Distance=Slider(350, range=0..1000), Corners=1)

# ----
# all analysised curves
crv_41 = Curve(data_16)

# ----
# 2.2下层建筑边线内侧300-600mm范围内
number_slider_12 = Slider(600, range=0..1000)
crv_42 = Curve(crv_39)
offset_11 = OffsetCurve(Curve=crv_42, Distance=expr("-x", number_slider_12), Corners=1)
offset_12 = OffsetCurve(Curve=crv_42, Distance=expr("-x", Slider(300, range=0..1000)), Corners=1)

# ----
# remove wrong lines
number_slider_13 = Slider(600, range=0..1000)

# ----
# remove wrong lines
number_slider_14 = Slider(600, range=0..1000)

# ----
# 下层建筑内侧到300到外侧50内
# 有钢结构
number_slider_15 = Slider(50, range=0..1000)
crv_43 = Curve(crv_39)
offset_13 = OffsetCurve(Curve=crv_43, Distance=expr("-x", Slider(300, range=0..1000)), Corners=1)
offset_14 = OffsetCurve(Curve=crv_43, Distance=number_slider_15, Corners=1)

# ----
# 求内部曲线转折点
crv_44 = Curve()  # disabled
number_slider_16 = Slider(300, range=0..1000)  # disabled
neg = Negative(Value=number_slider_16)  # disabled
filter_10 = StreamFilter(Gate=toggle, Stream0=number_slider_16, Stream1=neg)  # disabled
number_slider_17 = Slider(60, range=0..100)  # disabled

ext_3 = ExtendCurve(Curve=crv_44, Type=0, Start=number_slider, End=number_slider)  # disabled

# ----
# 第二层
# 
# Curves(location point)+ Smooth Curves(architecture line)
# 第二层-区分阴阳角
area_6 = Area(Geometry=geo_2)  # -> Area, Centroid; disabled
crv_45 = Curve(crv_44)  # disabled
pull_7 = PullPoint(Point=area_6.Centroid, Geometry=crv_45, ClosestOnly=True)  # -> ClosestPoint, Distance; disabled
number_slider_18 = Slider(200, range=0..1000)  # disabled
number_slider_19 = Slider(100, range=0..300)  # disabled

# ----
# 第二层-阴阳角
panel_26 = Panel("0.5 * Pi")  # disabled
toggle_2 = BooleanToggle(True)  # disabled
neg_2 = Negative(Value=panel_26)  # disabled
filter_11 = StreamFilter(Gate=toggle_2, Stream0=panel_26, Stream1=neg_2)  # disabled

# ----
# 第二层-大面定位
panel_27 = Panel("0.5 * Pi")  # disabled
toggle_3 = BooleanToggle(True)  # disabled
neg_3 = Negative(Value=panel_27)  # disabled
filter_12 = StreamFilter(Gate=toggle_3, Stream0=panel_27, Stream1=neg_3)  # disabled

number_slider_20 = Slider(300, range=0..1000)  # disabled
number_slider_21 = Slider(1.5, range=0..10)  # disabled

number_slider_22 = Slider(300, range=0..1000)  # disabled
number_slider_23 = Slider(1.5, range=0..10)  # disabled

number_slider_24 = Slider(300, range=0..1000)  # disabled
number_slider_25 = Slider(1.5, range=0..10)  # disabled

# ----
# 显示"False"时要选择线段延长
list_10 = ValueList({"线段不延长": 0, "线段延长": 1}, selected="线段延长")  # disabled

filter_13 = StreamFilter(Gate=list_10, Stream0=crv_44, Stream1=ext_3)  # disabled

disc_4 = Discontinuity(Curve=graft(filter_13), Level=1)  # -> Points, Parameters; disabled
crv_cp_2 = CurveClosestPoint(Point=disc_4.Points, Curve=graft(filter_13))  # -> Point, Parameter, Distance; disabled
eval_2 = EvaluateCurve(Curve=graft(filter_13), Parameter=crv_cp_2.Parameter)  # -> flatten(Point), Tangent, flatten(Angle); disabled
deg_2 = Degrees(Radians=eval_2.Angle)  # disabled
offset_15 = OffsetCurve(Curve=filter_13, Distance=expr("-X", filter_10), Corners=1)  # disabled
panel_28 = Panel(deg_2)  # disabled
larger_5 = LargerThan(FirstNumber=deg_2, SecondNumber=number_slider_17)  # -> LargerThan, OrEqualTo; disabled
disc_5 = Discontinuity(Curve=offset_15, Level=1)  # -> flatten(Points), Parameters; disabled
dispatch_20 = Dispatch(List=eval_2.Point, DispatchPattern=larger_5.LargerThan)  # -> ListA, ListB; disabled
end_2 = EndPoints(Curve=filter_13)  # -> Start, End; disabled
data_28 = Data(dispatch_20.ListA)  # disabled
pull_8 = PullPoint(Point=data_28, Geometry=flatten(offset_15), ClosestOnly=True)  # -> ClosestPoint, Distance; disabled
testpoint = TestPoint(archPoint=pull_8.ClosestPoint, crvPoint=disc_5.Points)  # -> out, specialPt; inputs archPoint: list of Point3d, crvPoint: list of Point3d; disabled
# ---------- testpoint: C# ----------
    List<int> passIndex = new List<int>();

    for(int i = 0; i < archPoint.Count; i++){
      foreach(Point3d t in crvPoint){
        if(archPoint[i].X == t.X && archPoint[i].Y == t.Y && archPoint[i].Z == t.Z){
          Print("pass");
          passIndex.Add(i);}
      }
    }

    specialPt = passIndex;
# ---------- end testpoint ----------

# ----
# 阴角
item_13 = ListItem(List=data_28, Index=testpoint.specialPt, Wrap=True)  # disabled

# ----
# SmoothCurve-阴角&阳角
# 阳角
cull_i_5 = CullIndex(List=data_28, Indices=testpoint.specialPt, Wrap=True)  # disabled

dist = Distance(PointA=pull_7.ClosestPoint, PointB=data_28)  # disabled
sort_4 = SortList(Keys=dist)  # -> Keys, ValuesA; disabled
panel_29 = Panel(sort_4.Keys)  # disabled
smaller_2 = SmallerThan(FirstNumber=dist, SecondNumber=number_slider_18)  # -> SmallerThan, OrEqualTo; disabled
dispatch_21 = Dispatch(List=geo_2, DispatchPattern=smaller_2.SmallerThan)  # -> ListA, ListB; disabled
crv_46 = Curve(filter_13)  # disabled

data_29 = Data(dispatch_21.ListA)  # disabled
explode_3 = Explode(Curve=data_29, Recursive=True)  # -> Segments, Vertices; disabled
len_4 = Length(Curve=explode_3.Segments)  # disabled
sort_5 = SortList(Keys=reverse(len_4), ValuesA=explode_3.Segments)  # -> Keys, ValuesA; disabled
item_14 = ListItem(List=sort_5.ValuesA, Index=0, Wrap=True)  # -> flatten(Item); disabled
area_7 = Area(Geometry=data_29)  # -> Area, Centroid; disabled
midpt_9 = CurveMiddle(Curve=item_14)  # disabled
move2pt = MoveToPoint(Geometry=item_14, PointA=midpt_9, PointB=area_7.Centroid)  # -> Moved, Vector, Transform; disabled
end_3 = EndPoints(Curve=move2pt.Moved)  # -> Start, End; disabled
ln_8 = Line(StartPoint=end_3.Start, EndPoint=end_3.End)  # disabled
xy_17 = XYPlane(Origin=end_3.End)  # disabled
rotate_2 = Rotate(Geometry=ln_8, Angle=filter_11, Plane=xy_17)  # -> Geometry, Transform; disabled
pl_2 = ConstructPlane(Origin=end_3.End, XAxis=rotate_2.Geometry, YAxis=ln_8)  # disabled

data_30 = Data(dispatch_21.ListB)  # disabled
explode_4 = Explode(Curve=data_30, Recursive=True)  # -> Segments, Vertices; disabled
len_5 = Length(Curve=explode_4.Segments)  # disabled
sort_6 = SortList(Keys=reverse(len_5), ValuesA=explode_4.Segments)  # -> Keys, ValuesA; disabled
item_15 = ListItem(List=sort_6.ValuesA, Index=0, Wrap=True)  # -> flatten(Item); disabled
area_8 = Area(Geometry=data_30)  # -> Area, Centroid; disabled
midpt_10 = CurveMiddle(Curve=item_15)  # disabled
move2pt_2 = MoveToPoint(Geometry=item_15, PointA=midpt_10, PointB=area_8.Centroid)  # -> Moved, Vector, Transform; disabled
end_4 = EndPoints(Curve=move2pt_2.Moved)  # -> Start, End; disabled
ln_9 = Line(StartPoint=end_4.Start, EndPoint=end_4.End)  # disabled
xy_18 = XYPlane(Origin=end_4.End)  # disabled
rotate_3 = Rotate(Geometry=ln_9, Angle=filter_12, Plane=xy_18)  # -> Geometry, Transform; disabled
pl_3 = ConstructPlane(Origin=end_4.End, XAxis=rotate_3.Geometry, YAxis=ln_9)  # disabled

data_31 = Data(flatten(pl_3))  # disabled
deplane_7 = DeconstructPlane(Plane=data_31)  # -> Origin, XAxis, YAxis, ZAxis; disabled
amp_3 = Amplitude(Vector=deplane_7.YAxis, Amplitude=number_slider_22)  # disabled
move_4 = Move(Geometry=deplane_7.Origin, Motion=amp_3)  # -> Geometry, Transform; disabled
ln_10 = Line(StartPoint=deplane_7.Origin, EndPoint=move_4.Geometry)  # disabled
midpt_11 = CurveMiddle(Curve=ln_10)  # disabled
scale_3 = Scale(Geometry=ln_10, Center=midpt_11, Factor=number_slider_23)  # -> Geometry, Transform; disabled
ccx_5 = CurveCurve(CurveA=scale_3.Geometry, CurveB=crv_46)  # -> Points, ParamsA, ParamsB; disabled

dist_2 = Distance(PointA=graft(end_3.End), PointB=cull_i_5)  # disabled
sort_7 = SortList(Keys=dist_2)  # -> Keys, ValuesA; disabled
item_16 = ListItem(List=sort_7.Keys, Index=0, Wrap=True)  # disabled
smaller_3 = SmallerThan(FirstNumber=item_16, SecondNumber=number_slider_19)  # -> SmallerThan, OrEqualTo; disabled
flatten_3 = FlattenTree(Tree=item_16, Path="{0}")  # disabled
dispatch_22 = Dispatch(List=graft(pl_2), DispatchPattern=smaller_3.SmallerThan)  # -> ListA, ListB; disabled
panel_30 = Panel(flatten_3)  # disabled
flatten_4 = FlattenTree(Tree=ccx_5.Points, Path="{0}")  # disabled
lng_3 = ListLength(List=scale_3.Geometry)  # disabled
lng_4 = ListLength(List=flatten_4)  # disabled

data_32 = Data(flatten(dispatch_22.ListA))  # disabled
deplane_8 = DeconstructPlane(Plane=data_32)  # -> Origin, XAxis, YAxis, ZAxis; disabled
amp_4 = Amplitude(Vector=deplane_8.YAxis, Amplitude=number_slider_20)  # disabled
move_5 = Move(Geometry=deplane_8.Origin, Motion=amp_4)  # -> Geometry, Transform; disabled
ln_11 = Line(StartPoint=deplane_8.Origin, EndPoint=move_5.Geometry)  # disabled
midpt_12 = CurveMiddle(Curve=ln_11)  # disabled
scale_4 = Scale(Geometry=ln_11, Center=midpt_12, Factor=number_slider_21)  # -> Geometry, Transform; disabled
ccx_6 = CurveCurve(CurveA=scale_4.Geometry, CurveB=crv_46)  # -> Points, ParamsA, ParamsB; disabled

data_33 = Data(flatten(dispatch_22.ListB))  # disabled
deplane_9 = DeconstructPlane(Plane=data_33)  # -> Origin, XAxis, YAxis, ZAxis; disabled
amp_5 = Amplitude(Vector=deplane_9.YAxis, Amplitude=number_slider_24)  # disabled
move_6 = Move(Geometry=deplane_9.Origin, Motion=amp_5)  # -> Geometry, Transform; disabled
ln_12 = Line(StartPoint=deplane_9.Origin, EndPoint=move_6.Geometry)  # disabled
midpt_13 = CurveMiddle(Curve=ln_12)  # disabled
scale_5 = Scale(Geometry=ln_12, Center=midpt_13, Factor=number_slider_25)  # -> Geometry, Transform; disabled
ccx_7 = CurveCurve(CurveA=scale_5.Geometry, CurveB=crv_46)  # -> Points, ParamsA, ParamsB; disabled

equals_2 = Equality(FirstNumber=lng_3, SecondNumber=lng_4)  # -> Equality, Inequality; disabled
panel_31 = Panel(equals_2.Equality)  # disabled

# ----
# InsideCurve-大面
move2pt_3 = MoveToPoint(Geometry=data_31, PointA=flatten(deplane_7.Origin), PointB=flatten(ccx_5.Points))  # -> Moved, Vector, Transform; disabled

# ----
# InsideCurve-阳角
move2pt_4 = MoveToPoint(Geometry=data_32, PointA=deplane_8.Origin, PointB=ccx_6.Points)  # -> Moved, Vector, Transform; disabled

# ----
# InsideCurve-阴角
move2pt_5 = MoveToPoint(Geometry=data_33, PointA=deplane_9.Origin, PointB=ccx_7.Points)  # -> Moved, Vector, Transform; disabled

# ---- group: 阴阳角区分
cp = ClosestPoint(Point=pt_2, Cloud=item_2)  # -> ClosestPoint, CPIndex, Distance
item_17 = ListItem(List=item_2, Index=cp.CPIndex, Wrap=True)
crv_cp_3 = CurveClosestPoint(Point=item_17, Curve=offset)  # -> Point, Parameter, Distance
eval_3 = EvaluateCurve(Curve=offset, Parameter=crv_cp_3.Parameter)  # -> Point, Tangent, Angle

# ----
# 板槽埋Modeling
multiplication = Multiplication(A=s_x, B=addition)
multiplication_2 = Multiplication(A=s_y, B=addition_2)
recgrid = Rectangular(Plane=PlaneXY(0, 0, 0), SizeX=s_x, SizeY=s_y, ExtentX=addition, ExtentY=addition_2)  # -> Cells, Points
直径 = Text(filter_4)
division_2 = Division(A=multiplication, B=2)
division_3 = Division(A=multiplication_2, B=2)
vec = VectorXYZ(XComponent=expr("-x", division_2), YComponent=expr("-x", division_3), ZComponent=0)  # -> Vector, Length
move_7 = Move(Geometry=recgrid.Points, Motion=vec.Vector)  # -> Geometry, Transform
division_4 = Division(A=直径, B=2)
cyl = Cylinder(Base=move_7.Geometry, Radius=division_4, Length=expr("-x", expression))
X = UnitX(Factor=直径)
multiplication_3 = Multiplication(A=直径, B=6)
edges_2 = BrepEdges(Brep=cyl)  # -> Naked, Interior, NonManifold
item_18 = ListItem(List=edges_2.Naked, Index=0, Wrap=True)
max_2 = Maximum(A=multiplication_3, B=70)
move_8 = Move(Geometry=item_18, Motion=X)  # -> Geometry, Transform
multiplication_4 = Multiplication(A=max_2, B=2)
addition_4 = Addition(A=multiplication, B=multiplication_4)
addition_5 = Addition(A=multiplication_2, B=multiplication_4)
division_5 = Division(A=t, B=2)
expression_2 = Expression(x=addition_5, Expression="Ceiling(x/10)*10/2")
expression_3 = Expression(x=addition_4, Expression="Ceiling(x/10)*10/2")
round = Round(Number=division_5)  # -> Nearest, Floor, Ceiling
multiplication_5 = Multiplication(A=round.Ceiling, B=2)
dom = ConstructDomain(DomainStart=expr("-x", expression_2), DomainEnd=expression_2)
dom_2 = ConstructDomain(DomainStart=expr("-x", expression_3), DomainEnd=expression_3)
box = DomainBox(Base=PlaneXY(0, 0, 0), X=dom_2, Y=dom, Z=multiplication_5)
Z = UnitZ(Factor=expr("-x", multiplication_5))

multiplication_6 = Multiplication(A=直径, B=5)

Z_2 = UnitZ(Factor=multiplication_6)
extr = Extrude(Base=move_8.Geometry, Direction=Z_2)
cap = CapHoles(Brep=[extr, cyl])
merge_11 = Merge(Data1=cap, Data2=box)
flatten_5 = FlattenTree(Tree=merge_11, Path="{0}")
move_9 = Move(Geometry=flatten_5, Motion=Z)  # -> Geometry, Transform

brep_4 = Brep(move_9.Geometry)

# ----
# 槽埋+板埋合并
bbox_3 = BoundingBox(Content=brep_3, Plane=PlaneXY(0, 0, 0))  # -> Box, Box_2
debox_3 = DeconstructBox(Box=bbox_3.Box)  # -> Plane, X, Y, Z
area_9 = Area(Geometry=brep_3)  # -> Area, Centroid
dedomain_3 = DeconstructDomain(Domain=debox_3.Z)  # -> Start, End
pdecon_3 = Deconstruct(Point=area_9.Centroid)  # -> XComponent, YComponent, ZComponent
xy_19 = XYPlane(Origin=Point(0, 0, 0))
pt_26 = ConstructPoint(XCoordinate=pdecon_3.XComponent, YCoordinate=pdecon_3.YComponent, ZCoordinate=dedomain_3.End)
pl_origin_3 = PlaneOrigin(Base=xy_19, Origin=pt_26)
xy_20 = XYPlane(Origin=Point(0, 0, 0))
orient_3 = Orient(Geometry=brep_3, Source=pl_origin_3, Target=xy_20)  # -> Geometry, Transform
bbox_4 = BoundingBox(Content=orient_3.Geometry, Plane=PlaneXY(0, 0, 0))  # -> Box, Box_2
sdiff = SolidDifference(BrepsA=move_9.Geometry, BrepsB=bbox_4.Box)
sunion_3 = SolidUnion(Breps=[sdiff, orient_3.Geometry])  # -> flatten(Result)

edges_3 = BrepEdges(Brep=bbox_3.Box)  # -> Naked, Interior, NonManifold
item_19 = ListItem(List=edges_3.Interior, Index="5", Wrap=True)
item_20 = ListItem(List=edges_3.Interior, Index="4", Wrap=True)
clx_2 = CurveLine(Curve=item_20, Line=item_19)  # -> Points, Params, Count
Y_2 = UnitY(Factor=item_19)
rotate_4 = Rotate(Geometry=brep_3, Angle=1.570796327, Plane=clx_2.Points)  # -> Geometry, Transform
move_10 = Move(Geometry=rotate_4.Geometry, Motion=Y_2)  # -> Geometry, Transform
merge_12 = Merge(Data1=brep_3, Data2=move_10.Geometry)  # -> flatten(Result)
sunion_4 = SolidUnion(Breps=merge_12)
bbox_5 = BoundingBox(Content=sunion_4, Plane=PlaneXY(0, 0, 0))  # -> Box, Box_2
area_10 = Area(Geometry=sunion_4)  # -> Area, Centroid
debox_4 = DeconstructBox(Box=bbox_5.Box)  # -> Plane, X, Y, Z
pdecon_4 = Deconstruct(Point=area_10.Centroid)  # -> XComponent, YComponent, ZComponent
dedomain_4 = DeconstructDomain(Domain=debox_4.Z)  # -> Start, End
pt_27 = ConstructPoint(XCoordinate=pdecon_4.XComponent, YCoordinate=pdecon_4.YComponent, ZCoordinate=dedomain_4.End)
xy_21 = XYPlane(Origin=Point(0, 0, 0))
pl_origin_4 = PlaneOrigin(Base=xy_21, Origin=pt_27)
xy_22 = XYPlane(Origin=Point(0, 0, 0))
orient_4 = Orient(Geometry=sunion_4, Source=pl_origin_4, Target=xy_22)  # -> Geometry, Transform

entwine_3 = Entwine(Branch00=sunion_3, Branch01=orient_4.Geometry, FlattenInputs=True)

# ----
# 板埋Modeling
multiplication_7 = Multiplication(A=s_x, B=addition)
multiplication_8 = Multiplication(A=s_y, B=addition_2)
recgrid_2 = Rectangular(Plane=PlaneXY(0, 0, 0), SizeX=s_x, SizeY=s_y, ExtentX=addition, ExtentY=addition_2)  # -> Cells, Points
直径_2 = Text(filter_4)
division_6 = Division(A=multiplication_7, B=2)
division_7 = Division(A=multiplication_8, B=2)
vec_2 = VectorXYZ(XComponent=expr("-x", division_6), YComponent=expr("-x", division_7), ZComponent=0)  # -> Vector, Length
move_11 = Move(Geometry=recgrid_2.Points, Motion=vec_2.Vector)  # -> Geometry, Transform
division_8 = Division(A=直径_2, B=2)
cyl_2 = Cylinder(Base=move_11.Geometry, Radius=division_8, Length=expr("-x", expression))
X_2 = UnitX(Factor=直径_2)
multiplication_9 = Multiplication(A=直径_2, B=6)
edges_4 = BrepEdges(Brep=cyl_2)  # -> Naked, Interior, NonManifold
item_21 = ListItem(List=edges_4.Naked, Index=0, Wrap=True)
max_3 = Maximum(A=multiplication_9, B=70)
move_12 = Move(Geometry=item_21, Motion=X_2)  # -> Geometry, Transform
multiplication_10 = Multiplication(A=max_3, B=2)
addition_6 = Addition(A=multiplication_7, B=multiplication_10)
addition_7 = Addition(A=multiplication_8, B=multiplication_10)
division_9 = Division(A=t, B=2)
expression_4 = Expression(x=addition_7, Expression="Ceiling(x/10)*10/2")
expression_5 = Expression(x=addition_6, Expression="Ceiling(x/10)*10/2")
round_2 = Round(Number=division_9)  # -> Nearest, Floor, Ceiling
multiplication_11 = Multiplication(A=round_2.Ceiling, B=2)
dom_3 = ConstructDomain(DomainStart=expr("-x", expression_4), DomainEnd=expression_4)
dom_4 = ConstructDomain(DomainStart=expr("-x", expression_5), DomainEnd=expression_5)
box_2 = DomainBox(Base=PlaneXY(0, 0, 0), X=dom_4, Y=dom_3, Z=multiplication_11)
Z_3 = UnitZ(Factor=expr("-x", multiplication_11))
move_13 = Move(Geometry=box_2, Motion=Z_3)  # -> Geometry, Transform
Z_4 = UnitZ(Factor=expr("-x", multiplication_11))

multiplication_12 = Multiplication(A=直径_2, B=5)

Z_5 = UnitZ(Factor=multiplication_12)
extr_2 = Extrude(Base=move_12.Geometry, Direction=Z_5)
cap_2 = CapHoles(Brep=[extr_2, cyl_2])
merge_13 = Merge(Data1=cap_2, Data2=box_2)
flatten_6 = FlattenTree(Tree=merge_13, Path="{0}")
move_14 = Move(Geometry=flatten_6, Motion=Z_4)  # -> Geometry, Transform

box_3 = DomainBox(Base=PlaneXY(0, 0, 0), X=dom_4, Y=dom_4, Z=multiplication_11)
merge_14 = Merge(Data1=cap_2, Data2=box_3)
flatten_7 = FlattenTree(Tree=merge_14, Path="{0}")
move_15 = Move(Geometry=flatten_7, Motion=Z_4)  # -> Geometry, Transform
entwine_4 = Entwine(Branch00=move_14.Geometry, Branch01=move_15.Geometry, FlattenInputs=True)

# ---- group: 选单体
板埋or槽埋or板槽埋 = StreamFilter(Gate=list, Stream0=entwine_4, Stream1=entwine_2, Stream2=entwine_3)

# ----
# 三视图
# hidden lines of top+pers view
# move to center
# 如果无法完整的生成埋件的三视图，
# 建议选择埋件的3D在Rhino中将
# Top/Perspective/Front/Right 试图缩放至合适大小后重新运行
panel_32 = Panel("""Top
Perspective
Front
Right""")
m2d_rhino = Make2DRhinoView(Name=panel_32, Clip=True)
make2d = Make2D(Geometry=板埋or槽埋or板槽埋, View=m2d_rhino, TangentEdges=False, TangentSeams=False, AutoComputeMake2D=False)  # -> VisibleCurves, VisibleIndex, VisibleType, HiddenCurves, HiddenIndex, HiddenType
bang_2 = ExplodeTree(Data=make2d.VisibleCurves)  # -> Branch0, Branch1, Branch2, Branch3, Branch4, Branch5, Branch6, Branch7
bang_3 = ExplodeTree(Data=make2d.VisibleCurves)  # -> Branch0, Branch1, Branch2, Branch3, Branch4, Branch5, Branch6, Branch7
divdist = DivideDistance(Curve=make2d.HiddenCurves, Distance=Slider(1, range=0..10))  # -> Points, Tangents, Parameters
graft_3 = GraftTree(Tree=make2d.HiddenCurves, IncludeEmptyLists=True, IncludeNullItems=True)
shatter = Shatter(Curve=graft_3, Parameters=divdist.Parameters)
dispatch_23 = Dispatch(List=shatter, DispatchPattern=[True, False])  # -> ListA, ListB
crv_47 = Curve(dispatch_23.ListA)
pshift_2 = ShiftPaths(Data=crv_47, Offset=-1)
pshift_3 = ShiftPaths(Data=pshift_2, Offset=-1)
bang_4 = ExplodeTree(Data=pshift_3)  # -> Branch0, Branch1, Branch2, Branch3, Branch4, Branch5, Branch6, Branch7
bang_5 = ExplodeTree(Data=pshift_3)  # -> Branch0, Branch1, Branch2, Branch3, Branch4, Branch5, Branch6, Branch7
entwine_5 = Entwine(Branch00=bang_5.Branch4, Branch01=bang_3.Branch4, FlattenInputs=True)  # -> flatten(Result)
entwine_6 = Entwine(Branch00=bang_5.Branch5, Branch01=bang_3.Branch5, FlattenInputs=True)  # -> flatten(Result)
entwine_7 = Entwine(Branch00=bang_4.Branch0, Branch01=bang_2.Branch0, FlattenInputs=True)  # -> flatten(Result)
entwine_8 = Entwine(Branch00=bang_4.Branch1, Branch01=bang_2.Branch1, FlattenInputs=True)  # -> flatten(Result)
entwine_9 = Entwine(Branch00=entwine_7, Branch01=entwine_8, Branch02=bang_2.Branch2, Branch03=bang_2.Branch3, FlattenInputs=True)
entwine_10 = Entwine(Branch00=entwine_5, Branch01=entwine_6, Branch02=bang_3.Branch6, Branch03=bang_3.Branch7, FlattenInputs=True)
group = Group(Objects=entwine_9)
group_2 = Group(Objects=entwine_10)
entwine_11 = Entwine(Branch00=group, Branch01=group_2, FlattenInputs=True)
pshift_4 = ShiftPaths(Data=entwine_11, Offset=-1)
pshift_5 = ShiftPaths(Data=entwine_11, Offset=-1)
number_slider_26 = Slider(2, range=0..10)
boxprop = BoxProperties(Box=pshift_4)  # -> Center, Diagonal, Area, Volume, Degeneracy
pt_28 = Point(Point(957.9296072, 367.7685097, 0))
pt_29 = Point("0,0,0")
recgrid_3 = Rectangular(
    Plane=pt_28,
    SizeX=Slider(12, range=1..20, expression="X*50"),
    SizeY=Slider(10, range=1..20, expression="X*50"),
    ExtentX=number_slider_26,
    ExtentY=number_slider_26)  # -> Cells, Points
vec2pt = Vector2Pt(PointA=boxprop.Center, PointB=pt_29, Unitize=False)  # -> Vector, Length
flatten_8 = FlattenTree(Tree=recgrid_3.Points, Path="{0}")
move_16 = Move(Geometry=pshift_5, Motion=vec2pt.Vector)  # -> flatten(Geometry), Transform
orient_5 = Orient(Geometry=flatten(move_16.Geometry), Source=PlaneXY(0, 0, 0), Target=flatten_8)  # -> Geometry, Transform
cull_i_6 = CullIndex(List=orient_5.Geometry, Indices="-1", Wrap=True)
split = SplitList(List=cull_i_6, Index="4")  # -> ListA, ListB
data_34 = Data(split.ListA)
data_35 = Data(split.ListB)
entwine_12 = Entwine(Branch00=data_34, Branch01=data_35, FlattenInputs=True)
geo_6 = Geometry(entwine_12)

# ---- group: 单体定Top/Side
item_22 = ListItem(List=geo_6, Index=2, Wrap=True)
item_23 = ListItem(List=geo_6, Index=Slider(0, range=0..10), Wrap=True)
cluster = Cluster(G=item_23)
cluster_2 = Cluster(G=item_22)

# ---- group: 单体定Top/Side / Top/Side
filter_14 = StreamFilter(Gate=list_2, Stream0=cluster, Stream1=cluster_2)

# ---- group: 单体定Top/Side / Monomer + Top/Side
filter_15 = StreamFilter(Gate=list, Stream0=filter_14, Stream1=filter_14, Stream2=filter_14)  # -> flatten(Stream)

# ---- group: Block
# 自定义块所在图层
# 自定义块所在图层颜色
# 自定义块名称
panel_33 = Panel("Embeded::Embeded")
layer_2 = DefineLayer(Name=panel_33, Color=ColourSwatch(SwatchColor=RGB(255, 0, 0)))
attributes = DefineObjectAttributes(Layer=layer_2)
block = DefineBlock(Geometry=filter_14, Attributes=attributes, BlockName="Steel Plate", BasePlane=PlaneXY(0, 0, 0))

# ---- group: 正常+阳角+阴角区分
cull_i_7 = CullIndex(List=item_2, Indices=cp.CPIndex, Wrap=True)
crv_48 = Curve(offset)
crv_49 = Curve(flip.Curve)
explode_5 = Explode(Curve=crv_48, Recursive=True)  # -> Segments, Vertices
explode_6 = Explode(Curve=crv_49, Recursive=True)  # -> Segments, Vertices

# ---- group: 阴角定位-细化
item_24 = ListItem(List=item, Index=cp.CPIndex, Wrap=True)

# ----
# 求主体曲线转折点
clscrv = CloseCurve(Curve=crv_11, CloseType=0, Bulge=0.5, Tolerance=0)  # -> Closed, R
crv_50 = Curve(crv_9)
disc_6 = Discontinuity(Curve=graft(crv_50), Level=1)  # -> Points, Parameters
crv_cp_4 = CurveClosestPoint(Point=disc_6.Points, Curve=graft(crv_50))  # -> Point, Parameter, Distance
eval_4 = EvaluateCurve(Curve=graft(crv_50), Parameter=crv_cp_4.Parameter)  # -> flatten(Point), Tangent, flatten(Angle)
deg_3 = Degrees(Radians=eval_4.Angle)
offset_16 = OffsetCurve(Curve=clscrv.Closed, Distance=expr("-X", Slider(300, range=0..1000)), Corners=1)
panel_34 = Panel(deg_3)
larger_6 = LargerThan(FirstNumber=deg_3, SecondNumber=Slider(60, range=0..100))  # -> LargerThan, OrEqualTo
disc_7 = Discontinuity(Curve=offset_16, Level=1)  # -> flatten(Points), Parameters
dispatch_24 = Dispatch(List=eval_4.Point, DispatchPattern=larger_6.LargerThan)  # -> ListA, ListB

# ----
# 第一层
# 
# Angular Curves(architecture line)
number_slider_27 = Slider(84, range=0..1000)
crv_51 = Curve(project_8.Geometry)
crv_52 = Curve(clscrv.Closed)
offset_17 = OffsetCurve(Curve=crv_52, Distance=expr("-x", number_slider_27), Corners=1)  # -> flatten(Curve)
disc_8 = Discontinuity(Curve=crv_51, Level=1)  # -> Points, Parameters
pull_9 = PullPoint(Point=disc_8.Points, Geometry=offset_17, ClosestOnly=True)  # -> ClosestPoint, Distance
disc_9 = Discontinuity(Curve=offset_17, Level=1)  # -> Points, Parameters
pull_10 = PullPoint(Point=flatten(pull_9.ClosestPoint), Geometry=flatten(disc_9.Points), ClosestOnly=True)  # -> ClosestPoint, Distance
check_same_points = CheckSamePoints(archPoint=flatten(pull_9.ClosestPoint), crvPoint=flatten(pull_10.ClosestPoint))  # -> out, specialPt; inputs archPoint: list of Point3d, crvPoint: list of Point3d; same code as testpoint
cull_i_8 = CullIndex(List=flatten(disc_8.Points), Indices=check_same_points.specialPt, Wrap=True)
end_5 = EndPoints(Curve=crv_51)  # -> Start, End
merge_15 = Merge(Data1=end_5.Start, Data2=end_5.End, Data3=cull_i_8)
flatten_9 = FlattenTree(Tree=disc_8.Points, Path="{0}")
check_same_points_2 = CheckSamePoints(archPoint=flatten(flatten_9), crvPoint=flatten(merge_15))  # -> out, specialPt; inputs archPoint: list of Point3d, crvPoint: list of Point3d; same code as testpoint
cull_i_9 = CullIndex(List=flatten(flatten_9), Indices=check_same_points_2.specialPt, Wrap=True)
pull_11 = PullPoint(Point=cull_i_9, Geometry=offset_17, ClosestOnly=True)  # -> ClosestPoint, Distance
ln_13 = Line(StartPoint=cull_i_9, EndPoint=pull_11.ClosestPoint)
rotate_5 = Rotate(Geometry=ln_13, Angle="Pi", Plane=cull_i_9)  # -> Geometry, Transform
rotate_6 = Rotate(Geometry=ln_13, Angle=1.570796327, Plane=cull_i_9)  # -> Geometry, Transform

# ----
# 第一层
# 
# Angular Curves(architecture line)
crv_53 = Curve(crv_10)
crv_54 = Curve(clscrv.Closed)
offset_18 = OffsetCurve(Curve=crv_54, Distance=expr("-x", Slider(84, range=0..1000)), Corners=1)  # -> flatten(Curve)
disc_10 = Discontinuity(Curve=crv_53, Level=1)  # -> Points, Parameters
pull_12 = PullPoint(Point=disc_10.Points, Geometry=offset_18, ClosestOnly=True)  # -> ClosestPoint, Distance
disc_11 = Discontinuity(Curve=offset_18, Level=1)  # -> Points, Parameters
pull_13 = PullPoint(Point=flatten(pull_12.ClosestPoint), Geometry=flatten(disc_11.Points), ClosestOnly=True)  # -> ClosestPoint, Distance
check_same_points_3 = CheckSamePoints(archPoint=flatten(pull_12.ClosestPoint), crvPoint=flatten(pull_13.ClosestPoint))  # -> out, specialPt; inputs archPoint: list of Point3d, crvPoint: list of Point3d; same code as testpoint
cull_i_10 = CullIndex(List=flatten(disc_10.Points), Indices=check_same_points_3.specialPt, Wrap=True)
end_6 = EndPoints(Curve=crv_53)  # -> Start, End
merge_16 = Merge(Data1=end_6.Start, Data2=end_6.End, Data3=cull_i_10)
flatten_10 = FlattenTree(Tree=disc_10.Points, Path="{0}")
check_same_points_4 = CheckSamePoints(archPoint=flatten(flatten_10), crvPoint=flatten(merge_16))  # -> out, specialPt; inputs archPoint: list of Point3d, crvPoint: list of Point3d; same code as testpoint
cull_i_11 = CullIndex(List=flatten(flatten_10), Indices=check_same_points_4.specialPt, Wrap=True)
pull_14 = PullPoint(Point=cull_i_11, Geometry=offset_18, ClosestOnly=True)  # -> ClosestPoint, Distance
ln_14 = Line(StartPoint=cull_i_11, EndPoint=pull_14.ClosestPoint)
rotate_7 = Rotate(Geometry=ln_14, Angle="Pi", Plane=cull_i_11)  # -> Geometry, Transform
rotate_8 = Rotate(Geometry=rotate_7.Geometry, Angle=-1.570796327, Plane=cull_i_11)  # -> Geometry, Transform

# ----
# 转角点
data_36 = Data(dispatch_24.ListA)

pull_15 = PullPoint(Point=data_36, Geometry=flatten(offset_16), ClosestOnly=True)  # -> ClosestPoint, Distance
testpoint_2 = TestPoint(archPoint=pull_15.ClosestPoint, crvPoint=disc_7.Points)  # -> out, specialPt; inputs archPoint: list of Point3d, crvPoint: list of Point3d; same code as testpoint

# ----
# 找阴阳角所在corners
pull_16 = PullPoint(Point=flatten(pln_10), Geometry=crv_50, ClosestOnly=True)  # -> ClosestPoint, Distance
pull_17 = PullPoint(Point=pull_16.ClosestPoint, Geometry=data_36, ClosestOnly=True)  # -> ClosestPoint, Distance
flatten_11 = FlattenTree(Tree=data_10, Path="{0}")
sort_8 = SortList(Keys=pull_17.Distance, ValuesA=flatten_11)  # -> Keys, ValuesA
panel_35 = Panel(sort_8.Keys)
smaller_4 = SmallerThan(FirstNumber=sort_8.Keys, SecondNumber=Slider(100, range=0..100))  # -> SmallerThan, OrEqualTo
dispatch_25 = Dispatch(List=sort_8.ValuesA, DispatchPattern=smaller_4.SmallerThan)  # -> ListA, ListB
data_37 = Data(dispatch_25.ListA)
deblock_6 = DeconstructBlock(Block=data_37)  # -> Name, Plane, Geometry
deplane_10 = DeconstructPlane(Plane=deblock_6.Plane)  # -> Origin, XAxis, YAxis, ZAxis
pt_30 = Point(data_36)
pull_18 = PullPoint(Point=deplane_10.Origin, Geometry=pt_30, ClosestOnly=True)  # -> ClosestPoint, Distance
cir = Circle(Plane=pull_18.ClosestPoint, Radius=Slider(300, range=0..1000))
crv_55 = Curve(crv_50)
amp_6 = Amplitude(Vector=deplane_10.YAxis, Amplitude=Slider(200, range=0..1000))
ccx_8 = CurveCurve(CurveA=cir, CurveB=crv_55)  # -> Points, ParamsA, ParamsB
move_17 = Move(Geometry=pull_18.ClosestPoint, Motion=amp_6)  # -> Geometry, Transform
item_25 = ListItem(List=ccx_8.Points, Index=0, Wrap=True)
clean = CleanTree(RemoveNulls=True, RemoveInvalid=True, RemoveEmpty=Toggle(True), Tree=item_25)
ln_15 = Line(StartPoint=pull_18.ClosestPoint, EndPoint=clean)
ln_16 = Line(StartPoint=pull_18.ClosestPoint, EndPoint=move_17.Geometry)
angle_2 = Angle(VectorA=ln_16, VectorB=ln_15)  # -> Angle, Reflex
deg_4 = Degrees(Radians=angle_2.Angle)
flatten_12 = FlattenTree(Tree=deg_4, Path="{0}")
panel_36 = Panel(flatten_12)
c_script = CSharpScript(angle=flatten_12, minus=Slider(80, range=0..100))  # -> out, results; inputs angle: list of Double, minus: Double
# ---------- c_script: C# ----------
    List<double> MyAngle = new List<double>();
    for(int i = 0; i < angle.Count; i++){
      if (angle[i] > minus){
        angleEach = angle[i] - 90;
        Print("!!!!!!!!");
        MyAngle.Add(angleEach);
      }
      else{
        angleEach = angle[i];
        Print("00000");
        MyAngle.Add(angleEach);
      }

    }

    results = MyAngle;
# ---------- c_script: C# additional code ----------
  double angleEach = 0;
# ---------- end c_script ----------
larger_7 = LargerThan(FirstNumber=c_script.results, SecondNumber=Slider(30, range=0..100))  # -> LargerThan, OrEqualTo
panel_37 = Panel(c_script.results)
dispatch_26 = Dispatch(List=flatten(data_37), DispatchPattern=flatten(larger_7.LargerThan))  # -> ListA, ListB
data_38 = Data(dispatch_26.ListA)

# ----
# SmoothCurve-阴角&阳角
# 阳角
item_26 = ListItem(List=data_36, Index=testpoint_2.specialPt, Wrap=True)

# ----
# 阴角
cull_i_12 = CullIndex(List=data_36, Indices=testpoint_2.specialPt, Wrap=True)

# ----
# remove duplicate block and reconstruct plane
deblock_7 = DeconstructBlock(Block=data_38)  # -> Name, Plane, Geometry
deplane_11 = DeconstructPlane(Plane=flatten(deblock_7.Plane))  # -> Origin, XAxis, YAxis, ZAxis

# ----
# 第一层
# 
# Block(location point) + Smooth Curves(architecture line)
# For Correct Plane
pln_13 = Plane(flatten(pln_10))
deplane_12 = DeconstructPlane(Plane=pln_13)  # -> Origin, XAxis, YAxis, ZAxis
testpoint_3 = TestPoint(archPoint=deplane_12.Origin, crvPoint=deplane_11.Origin)  # -> out, specialPt; inputs archPoint: list of Point3d, crvPoint: list of Point3d; same code as testpoint
cull_i_13 = CullIndex(List=pln_13, Indices=testpoint_3.specialPt, Wrap=True)
pln_14 = Plane(deblock_7.Plane)
dist_3 = Distance(PointA=graft(deplane_11.Origin), PointB=item_26)
sort_9 = SortList(Keys=dist_3)  # -> Keys, ValuesA
item_27 = ListItem(List=sort_9.Keys, Index=0, Wrap=True)
flatten_13 = FlattenTree(Tree=item_27, Path="{0}")
smaller_5 = SmallerThan(FirstNumber=item_27, SecondNumber=Slider(100, range=0..300))  # -> SmallerThan, OrEqualTo
panel_38 = Panel(flatten_13)
dispatch_27 = Dispatch(List=graft(pln_14), DispatchPattern=smaller_5.SmallerThan)  # -> ListA, ListB

# ----
# Angular Curve - All
pl_4 = ConstructPlane(Origin=cull_i_11, XAxis=rotate_7.Geometry, YAxis=rotate_8.Geometry)

# ----
# Curve for this project only - All
pl_5 = ConstructPlane(Origin=cull_i_9, XAxis=rotate_5.Geometry, YAxis=rotate_6.Geometry)

# ----
# 求主体曲线转折点
clscrv_2 = CloseCurve(Curve=crv_11, CloseType=0, Bulge=0.5, Tolerance=0)  # -> Closed, R
crv_56 = Curve(crv_9)
disc_12 = Discontinuity(Curve=graft(crv_56), Level=1)  # -> Points, Parameters
crv_cp_5 = CurveClosestPoint(Point=disc_12.Points, Curve=graft(crv_56))  # -> Point, Parameter, Distance
eval_5 = EvaluateCurve(Curve=graft(crv_56), Parameter=crv_cp_5.Parameter)  # -> flatten(Point), Tangent, flatten(Angle)
deg_5 = Degrees(Radians=eval_5.Angle)
offset_19 = OffsetCurve(Curve=clscrv_2.Closed, Distance=expr("-X", Slider(300, range=0..1000)), Corners=1)
panel_39 = Panel(deg_5)
larger_8 = LargerThan(FirstNumber=deg_5, SecondNumber=Slider(60, range=0..100))  # -> LargerThan, OrEqualTo
disc_13 = Discontinuity(Curve=offset_19, Level=1)  # -> flatten(Points), Parameters
dispatch_28 = Dispatch(List=eval_5.Point, DispatchPattern=larger_8.LargerThan)  # -> ListA, ListB

# ----
# 转角点
data_39 = Data(dispatch_28.ListA)

pull_19 = PullPoint(Point=data_39, Geometry=flatten(offset_19), ClosestOnly=True)  # -> ClosestPoint, Distance
testpoint_4 = TestPoint(archPoint=pull_19.ClosestPoint, crvPoint=disc_13.Points)  # -> out, specialPt; inputs archPoint: list of Point3d, crvPoint: list of Point3d; same code as testpoint

# ----
# 找阴阳角所在corners
pull_20 = PullPoint(Point=flatten(pln_11), Geometry=crv_56, ClosestOnly=True)  # -> ClosestPoint, Distance
pull_21 = PullPoint(Point=pull_20.ClosestPoint, Geometry=data_39, ClosestOnly=True)  # -> ClosestPoint, Distance
flatten_14 = FlattenTree(Tree=data_11, Path="{0}")
sort_10 = SortList(Keys=pull_21.Distance, ValuesA=flatten_14)  # -> Keys, ValuesA
panel_40 = Panel(sort_10.Keys)
smaller_6 = SmallerThan(FirstNumber=sort_10.Keys, SecondNumber=Slider(100, range=0..100))  # -> SmallerThan, OrEqualTo
dispatch_29 = Dispatch(List=sort_10.ValuesA, DispatchPattern=smaller_6.SmallerThan)  # -> ListA, ListB
data_40 = Data(dispatch_29.ListA)
deblock_8 = DeconstructBlock(Block=data_40)  # -> Name, Plane, Geometry
deplane_13 = DeconstructPlane(Plane=deblock_8.Plane)  # -> Origin, XAxis, YAxis, ZAxis
pt_31 = Point(data_39)
pull_22 = PullPoint(Point=deplane_13.Origin, Geometry=pt_31, ClosestOnly=True)  # -> ClosestPoint, Distance
cir_2 = Circle(Plane=pull_22.ClosestPoint, Radius=Slider(300, range=0..1000))
crv_57 = Curve(crv_56)
amp_7 = Amplitude(Vector=deplane_13.YAxis, Amplitude=Slider(200, range=0..1000))
ccx_9 = CurveCurve(CurveA=cir_2, CurveB=crv_57)  # -> Points, ParamsA, ParamsB
move_18 = Move(Geometry=pull_22.ClosestPoint, Motion=amp_7)  # -> Geometry, Transform
item_28 = ListItem(List=ccx_9.Points, Index=0, Wrap=True)
clean_2 = CleanTree(RemoveNulls=True, RemoveInvalid=True, RemoveEmpty=Toggle(True), Tree=item_28)
ln_17 = Line(StartPoint=pull_22.ClosestPoint, EndPoint=clean_2)
ln_18 = Line(StartPoint=pull_22.ClosestPoint, EndPoint=move_18.Geometry)
angle_3 = Angle(VectorA=ln_18, VectorB=ln_17)  # -> Angle, Reflex
deg_6 = Degrees(Radians=angle_3.Angle)
flatten_15 = FlattenTree(Tree=deg_6, Path="{0}")
panel_41 = Panel(flatten_15)
c_script_2 = CSharpScript(angle=flatten_15, minus=Slider(80, range=0..100))  # -> out, results; inputs angle: list of Double, minus: Double; same code as c_script
larger_9 = LargerThan(FirstNumber=c_script_2.results, SecondNumber=Slider(30, range=0..100))  # -> LargerThan, OrEqualTo
panel_42 = Panel(c_script_2.results)
dispatch_30 = Dispatch(List=flatten(data_40), DispatchPattern=flatten(larger_9.LargerThan))  # -> ListA, ListB
data_41 = Data(dispatch_30.ListA)

# ----
# SmoothCurve-阴角&阳角
# 阳角
item_29 = ListItem(List=data_39, Index=testpoint_4.specialPt, Wrap=True)

# ----
# 阴角
cull_i_14 = CullIndex(List=data_39, Indices=testpoint_4.specialPt, Wrap=True)

# ----
# remove duplicate block and reconstruct plane
deblock_9 = DeconstructBlock(Block=data_41)  # -> Name, Plane, Geometry
deplane_14 = DeconstructPlane(Plane=flatten(deblock_9.Plane))  # -> Origin, XAxis, YAxis, ZAxis

# ----
# 第一层
# 
# Block(location point) + Smooth Curves(architecture line)
# 
# For Wrong Plane
pln_15 = Plane(flatten(pln_11))
deplane_15 = DeconstructPlane(Plane=pln_15)  # -> Origin, XAxis, YAxis, ZAxis
testpoint_5 = TestPoint(archPoint=deplane_15.Origin, crvPoint=deplane_14.Origin)  # -> out, specialPt; inputs archPoint: list of Point3d, crvPoint: list of Point3d; same code as testpoint
cull_i_15 = CullIndex(List=pln_15, Indices=testpoint_5.specialPt, Wrap=True)
pln_16 = Plane(deblock_9.Plane)
dist_4 = Distance(PointA=graft(deplane_14.Origin), PointB=item_29)
sort_11 = SortList(Keys=dist_4)  # -> Keys, ValuesA
item_30 = ListItem(List=sort_11.Keys, Index=0, Wrap=True)
flatten_16 = FlattenTree(Tree=item_30, Path="{0}")
smaller_7 = SmallerThan(FirstNumber=item_30, SecondNumber=Slider(100, range=0..300))  # -> SmallerThan, OrEqualTo
panel_43 = Panel(flatten_16)
dispatch_31 = Dispatch(List=graft(pln_16), DispatchPattern=smaller_7.SmallerThan)  # -> ListA, ListB

crv_58 = Curve(crv_9)
crv_59 = Curve(crv_9)
pln_17 = Plane(cull_i_13)
crv_60 = Curve(crv_9)
pln_18 = Plane(cull_i_15)

data_42 = Data(flatten(dispatch_27.ListA))
deplane_16 = DeconstructPlane(Plane=data_42)  # -> Origin, XAxis, YAxis, ZAxis
amp_8 = Amplitude(Vector=deplane_16.YAxis, Amplitude=Slider(300, range=0..1000))
move_19 = Move(Geometry=deplane_16.Origin, Motion=amp_8)  # -> Geometry, Transform
ln_19 = Line(StartPoint=deplane_16.Origin, EndPoint=move_19.Geometry)
midpt_14 = CurveMiddle(Curve=ln_19)
scale_6 = Scale(Geometry=ln_19, Center=midpt_14, Factor=Slider(1.5, range=0..10))  # -> Geometry, Transform
ccx_10 = CurveCurve(CurveA=graft(scale_6.Geometry), CurveB=crv_59)  # -> flatten(Points), ParamsA, ParamsB

data_43 = Data(flatten(dispatch_27.ListB))
deplane_17 = DeconstructPlane(Plane=data_43)  # -> Origin, XAxis, YAxis, ZAxis
amp_9 = Amplitude(Vector=deplane_17.YAxis, Amplitude=Slider(300, range=0..1000))
move_20 = Move(Geometry=deplane_17.Origin, Motion=amp_9)  # -> Geometry, Transform
ln_20 = Line(StartPoint=deplane_17.Origin, EndPoint=move_20.Geometry)
midpt_15 = CurveMiddle(Curve=ln_20)
scale_7 = Scale(Geometry=ln_20, Center=midpt_15, Factor=Slider(1.5, range=0..10))  # -> Geometry, Transform
ccx_11 = CurveCurve(CurveA=graft(scale_7.Geometry), CurveB=crv_59)  # -> flatten(Points), ParamsA, ParamsB

data_44 = Data(flatten(pln_17))
deplane_18 = DeconstructPlane(Plane=data_44)  # -> Origin, XAxis, YAxis, ZAxis
amp_10 = Amplitude(Vector=deplane_18.YAxis, Amplitude=Slider(300, range=0..1000))
move_21 = Move(Geometry=deplane_18.Origin, Motion=amp_10)  # -> Geometry, Transform
ln_21 = Line(StartPoint=deplane_18.Origin, EndPoint=move_21.Geometry)
midpt_16 = CurveMiddle(Curve=ln_21)
scale_8 = Scale(Geometry=ln_21, Center=midpt_16, Factor=Slider(4.7, range=0..10))  # -> Geometry, Transform
ccx_12 = CurveCurve(CurveA=graft(scale_8.Geometry), CurveB=crv_59)  # -> flatten(Points), ParamsA, ParamsB

data_45 = Data(flatten(dispatch_31.ListA))
deplane_19 = DeconstructPlane(Plane=data_45)  # -> Origin, XAxis, YAxis, ZAxis
amp_11 = Amplitude(Vector=deplane_19.YAxis, Amplitude=Slider(300, range=0..1000))
move_22 = Move(Geometry=deplane_19.Origin, Motion=amp_11)  # -> Geometry, Transform
ln_22 = Line(StartPoint=deplane_19.Origin, EndPoint=move_22.Geometry)
midpt_17 = CurveMiddle(Curve=ln_22)
scale_9 = Scale(Geometry=ln_22, Center=midpt_17, Factor=Slider(1.5, range=0..10))  # -> Geometry, Transform
ccx_13 = CurveCurve(CurveA=graft(scale_9.Geometry), CurveB=crv_60)  # -> flatten(Points), ParamsA, ParamsB

data_46 = Data(flatten(dispatch_31.ListB))
deplane_20 = DeconstructPlane(Plane=data_46)  # -> Origin, XAxis, YAxis, ZAxis
amp_12 = Amplitude(Vector=deplane_20.YAxis, Amplitude=Slider(300, range=0..1000))
move_23 = Move(Geometry=deplane_20.Origin, Motion=amp_12)  # -> Geometry, Transform
ln_23 = Line(StartPoint=deplane_20.Origin, EndPoint=move_23.Geometry)
midpt_18 = CurveMiddle(Curve=ln_23)
scale_10 = Scale(Geometry=ln_23, Center=midpt_18, Factor=Slider(1.5, range=0..10))  # -> Geometry, Transform
ccx_14 = CurveCurve(CurveA=graft(scale_10.Geometry), CurveB=crv_60)  # -> flatten(Points), ParamsA, ParamsB

data_47 = Data(flatten(pln_18))
deplane_21 = DeconstructPlane(Plane=data_47)  # -> Origin, XAxis, YAxis, ZAxis
amp_13 = Amplitude(Vector=deplane_21.YAxis, Amplitude=Slider(300, range=0..1000))
move_24 = Move(Geometry=deplane_21.Origin, Motion=amp_13)  # -> Geometry, Transform
ln_24 = Line(StartPoint=deplane_21.Origin, EndPoint=move_24.Geometry)
midpt_19 = CurveMiddle(Curve=ln_24)
scale_11 = Scale(Geometry=ln_24, Center=midpt_19, Factor=Slider(4.7, range=0..10))  # -> Geometry, Transform
ccx_15 = CurveCurve(CurveA=graft(scale_11.Geometry), CurveB=crv_60)  # -> flatten(Points), ParamsA, ParamsB

move2pt_6 = MoveToPoint(Geometry=data_47, PointA=deplane_21.Origin, PointB=ccx_15.Points)  # -> Moved, Vector, Transform
move2pt_7 = MoveToPoint(Geometry=data_45, PointA=deplane_19.Origin, PointB=ccx_13.Points)  # -> Moved, Vector, Transform
move2pt_8 = MoveToPoint(Geometry=data_46, PointA=deplane_20.Origin, PointB=ccx_14.Points)  # -> Moved, Vector, Transform
xy_23 = XYPlane(Origin=move2pt_6.Moved)
xy_24 = XYPlane(Origin=move2pt_7.Moved)
xy_25 = XYPlane(Origin=move2pt_8.Moved)
rotate_9 = Rotate(Geometry=move2pt_6.Moved, Angle="Pi", Plane=xy_23)  # -> Geometry, Transform
rotate_10 = Rotate(Geometry=move2pt_7.Moved, Angle="Pi", Plane=xy_24)  # -> Geometry, Transform
rotate_11 = Rotate(Geometry=move2pt_8.Moved, Angle="Pi", Plane=xy_25)  # -> Geometry, Transform

# ----
# SmoothCurve-正常
toggle_4 = BooleanToggle(True)
filter_16 = StreamFilter(Gate=toggle_4, Stream0=move2pt_6.Moved, Stream1=rotate_9.Geometry)

# ----
# SmoothCurve-阳角
toggle_5 = BooleanToggle(True)
filter_17 = StreamFilter(Gate=toggle_5, Stream0=move2pt_7.Moved, Stream1=rotate_10.Geometry)

# ----
# SmoothCurve-阴角
toggle_6 = BooleanToggle(True)
filter_18 = StreamFilter(Gate=toggle_6, Stream0=move2pt_8.Moved, Stream1=rotate_11.Geometry)

# ----
# SmoothCurve-正常
move2pt_9 = MoveToPoint(Geometry=data_44, PointA=deplane_18.Origin, PointB=ccx_12.Points)  # -> Moved, Vector, Transform

# ----
# SmoothCurve-阳角
move2pt_10 = MoveToPoint(Geometry=data_42, PointA=deplane_16.Origin, PointB=ccx_10.Points)  # -> Moved, Vector, Transform

# ----
# SmoothCurve-阴角
move2pt_11 = MoveToPoint(Geometry=data_43, PointA=deplane_17.Origin, PointB=ccx_11.Points)  # -> Moved, Vector, Transform

# ----
# 第一层
# 
# Curves(location point)+ Smooth Curves(architecture line)
# 第二层-大面定位
area_11 = Area(Geometry=geo_5)  # -> Area, Centroid
pull_23 = PullPoint(Point=area_11.Centroid, Geometry=crv_58, ClosestOnly=True)  # -> ClosestPoint, Distance
dist_5 = Distance(PointA=pull_23.ClosestPoint, PointB=data_36)
sort_12 = SortList(Keys=dist_5)  # -> Keys, ValuesA
panel_44 = Panel(sort_12.Keys)
smaller_8 = SmallerThan(FirstNumber=dist_5, SecondNumber=Slider(200, range=0..1000))  # -> SmallerThan, OrEqualTo
dispatch_32 = Dispatch(List=geo_5, DispatchPattern=smaller_8.SmallerThan)  # -> ListA, ListB
data_48 = Data(dispatch_32.ListB)
explode_7 = Explode(Curve=data_48, Recursive=True)  # -> Segments, Vertices
len_6 = Length(Curve=explode_7.Segments)
sort_13 = SortList(Keys=reverse(len_6), ValuesA=explode_7.Segments)  # -> Keys, ValuesA
item_31 = ListItem(List=sort_13.ValuesA, Index=0, Wrap=True)  # -> flatten(Item)
area_12 = Area(Geometry=data_48)  # -> Area, Centroid
midpt_20 = CurveMiddle(Curve=item_31)
move2pt_12 = MoveToPoint(Geometry=item_31, PointA=midpt_20, PointB=area_12.Centroid)  # -> Moved, Vector, Transform
end_7 = EndPoints(Curve=move2pt_12.Moved)  # -> Start, End
pull_24 = PullPoint(Point=end_7.Start, Geometry=crv_58, ClosestOnly=True)  # -> ClosestPoint, Distance
neg_4 = Negative(Value="1.5 * Pi")
crv_cp_6 = CurveClosestPoint(Point=graft(pull_24.ClosestPoint), Curve=crv_58)  # -> Point, Parameter, Distance
filter_19 = StreamFilter(Gate=Toggle(True), Stream0="1.5 * Pi", Stream1=neg_4)
eval_6 = EvaluateCurve(Curve=crv_58, Parameter=crv_cp_6.Parameter)  # -> Point, Tangent, Angle
pull_25 = PullPoint(Point=eval_6.Point, Geometry=pull_24.ClosestPoint, ClosestOnly=True)  # -> ClosestPoint, Distance
sort_14 = SortList(Keys=pull_25.Distance, ValuesA=eval_6.Point)  # -> Keys, ValuesA
sort_15 = SortList(Keys=pull_25.Distance, ValuesA=eval_6.Tangent)  # -> Keys, ValuesA
item_32 = ListItem(List=sort_15.ValuesA, Index="0", Wrap=True)
item_33 = ListItem(List=sort_14.ValuesA, Index="0", Wrap=True)
amp_14 = Amplitude(Vector=item_32, Amplitude=Slider(100, range=0..100))
move_25 = Move(Geometry=item_33, Motion=amp_14)  # -> Geometry, Transform
xy_26 = XYPlane(Origin=item_33)
rotate_12 = Rotate(Geometry=move_25.Geometry, Angle="1 * Pi", Plane=xy_26)  # -> Geometry, Transform
ln_25 = Line(StartPoint=item_33, EndPoint=rotate_12.Geometry)
crv_61 = Curve(crv_9)
rotate_13 = Rotate(Geometry=ln_25, Angle=filter_19, Plane=xy_26)  # -> Geometry, Transform

# ----
# 第二层-阴阳角
data_49 = Data(dispatch_32.ListA)
explode_8 = Explode(Curve=data_49, Recursive=True)  # -> Segments, Vertices
len_7 = Length(Curve=explode_8.Segments)
sort_16 = SortList(Keys=reverse(len_7), ValuesA=explode_8.Segments)  # -> Keys, ValuesA
item_34 = ListItem(List=sort_16.ValuesA, Index=0, Wrap=True)  # -> flatten(Item)
area_13 = Area(Geometry=data_49)  # -> Area, Centroid
midpt_21 = CurveMiddle(Curve=item_34)
move2pt_13 = MoveToPoint(Geometry=item_34, PointA=midpt_21, PointB=area_13.Centroid)  # -> Moved, Vector, Transform
end_8 = EndPoints(Curve=move2pt_13.Moved)  # -> Start, End
ln_26 = Line(StartPoint=end_8.Start, EndPoint=end_8.End)
neg_5 = Negative(Value="0.5 * Pi")
filter_20 = StreamFilter(Gate=Toggle(True), Stream0="0.5 * Pi", Stream1=neg_5)
xy_27 = XYPlane(Origin=end_8.End)
rotate_14 = Rotate(Geometry=ln_26, Angle=filter_20, Plane=xy_27)  # -> Geometry, Transform
pl_6 = ConstructPlane(Origin=end_8.End, XAxis=rotate_14.Geometry, YAxis=ln_26)

dist_6 = Distance(PointA=graft(end_8.End), PointB=item_26)
sort_17 = SortList(Keys=dist_6)  # -> Keys, ValuesA
item_35 = ListItem(List=sort_17.Keys, Index=0, Wrap=True)
smaller_9 = SmallerThan(FirstNumber=item_35, SecondNumber=Slider(100, range=0..300))  # -> SmallerThan, OrEqualTo
flatten_17 = FlattenTree(Tree=item_35, Path="{0}")
dispatch_33 = Dispatch(List=graft(pl_6), DispatchPattern=smaller_9.SmallerThan)  # -> ListA, ListB
panel_45 = Panel(flatten_17)

data_50 = Data(flatten(dispatch_33.ListA))
deplane_22 = DeconstructPlane(Plane=data_50)  # -> Origin, XAxis, YAxis, ZAxis
amp_15 = Amplitude(Vector=deplane_22.YAxis, Amplitude=Slider(300, range=0..1000))
move_26 = Move(Geometry=deplane_22.Origin, Motion=amp_15)  # -> Geometry, Transform
ln_27 = Line(StartPoint=deplane_22.Origin, EndPoint=move_26.Geometry)
midpt_22 = CurveMiddle(Curve=ln_27)
scale_12 = Scale(Geometry=ln_27, Center=midpt_22, Factor=Slider(1.5, range=0..10))  # -> Geometry, Transform
ccx_16 = CurveCurve(CurveA=graft(scale_12.Geometry), CurveB=crv_61)  # -> flatten(Points), ParamsA, ParamsB

data_51 = Data(flatten(dispatch_33.ListB))
deplane_23 = DeconstructPlane(Plane=data_51)  # -> Origin, XAxis, YAxis, ZAxis
amp_16 = Amplitude(Vector=deplane_23.YAxis, Amplitude=Slider(300, range=0..1000))
move_27 = Move(Geometry=deplane_23.Origin, Motion=amp_16)  # -> Geometry, Transform
ln_28 = Line(StartPoint=deplane_23.Origin, EndPoint=move_27.Geometry)
midpt_23 = CurveMiddle(Curve=ln_28)
scale_13 = Scale(Geometry=ln_28, Center=midpt_23, Factor=Slider(1.5, range=0..10))  # -> Geometry, Transform
ccx_17 = CurveCurve(CurveA=graft(scale_13.Geometry), CurveB=crv_61)  # -> flatten(Points), ParamsA, ParamsB

# ----
# SmoothCurve-阳角
move2pt_14 = MoveToPoint(Geometry=data_50, PointA=deplane_22.Origin, PointB=ccx_16.Points)  # -> Moved, Vector, Transform

# ----
# SmoothCurve-阴角
move2pt_15 = MoveToPoint(Geometry=data_51, PointA=deplane_23.Origin, PointB=ccx_17.Points)  # -> Moved, Vector, Transform

# ----
# SmoothCurve-正常
pl_7 = ConstructPlane(Origin=move_25.Geometry, XAxis=ln_25, YAxis=rotate_13.Geometry)

merge_17 = Merge(
    Data1=move2pt_9.Moved,
    Data2=move2pt_10.Moved,
    Data3=move2pt_11.Moved,
    Data4=filter_16,
    Data5=filter_17,
    Data6=filter_18,
    Data7=move2pt_14.Moved,
    Data8=move2pt_15.Moved,
    Data9=pl_7,
    Data10=pl_4,
    Data11=pl,
    Data12=pl_5)  # -> flatten(Result)

# ----
# 1.是否有檐口线
clean_3 = CleanTree(RemoveNulls=True, RemoveInvalid=True, RemoveEmpty=Toggle(True), Tree=merge_17)
deplane_24 = DeconstructPlane(Plane=clean_3)  # -> Origin, XAxis, YAxis, ZAxis
incurve = PointInCurve(Point=deplane_24.Origin, Curve=crv_16)  # -> Relationship, Point
equals_3 = Equality(FirstNumber=incurve.Relationship, SecondNumber="2")  # -> Equality, Inequality
dispatch_34 = Dispatch(List=clean_3, DispatchPattern=equals_3.Equality)  # -> ListA, ListB

# ----
# 1.0无檐口线
pln_19 = Plane(dispatch_34.ListB)

crv_62 = Curve(crv_14)
crv_63 = Curve(crv_11)
number_slider_28 = Slider(3584, range=0..10000)
deplane_25 = DeconstructPlane(Plane=pln_19)  # -> Origin, XAxis, YAxis, ZAxis
amp_17 = Amplitude(Vector=deplane_25.YAxis, Amplitude=number_slider_28)
amp_18 = Amplitude(Vector=deplane_25.YAxis, Amplitude=expr("-x", number_slider_28))
move_28 = Move(Geometry=deplane_25.Origin, Motion=amp_18)  # -> Geometry, Transform
move_29 = Move(Geometry=deplane_25.Origin, Motion=amp_17)  # -> Geometry, Transform
ln_29 = Line(StartPoint=move_28.Geometry, EndPoint=move_29.Geometry)
ccx_18 = CurveCurve(CurveA=ln_29, CurveB=crv_63)  # -> flatten(Points), ParamsA, ParamsB
ccx_19 = CurveCurve(CurveA=ln_29, CurveB=crv_62)  # -> flatten(Points), ParamsA, ParamsB
pull_26 = PullPoint(Point=ccx_19.Points, Geometry=ccx_18.Points, ClosestOnly=True)  # -> ClosestPoint, Distance
sort_18 = SortList(Keys=pull_26.Distance, ValuesA=pull_26.ClosestPoint)  # -> Keys, ValuesA
panel_46 = Panel(sort_18.Keys)
larger_10 = LargerThan(FirstNumber=sort_18.Keys, SecondNumber=Slider(1.1, range=0..10))  # -> LargerThan, OrEqualTo
dispatch_35 = Dispatch(List=sort_18.ValuesA, DispatchPattern=larger_10.LargerThan)  # -> ListA, ListB
pt_32 = Point(dispatch_35.ListB)
pt_33 = Point(dispatch_35.ListA)
pull_27 = PullPoint(Point=deplane_25.Origin, Geometry=graft(pt_32), ClosestOnly=True)  # -> ClosestPoint, Distance
sort_19 = SortList(Keys=pull_27.Distance, ValuesA=pln_19)  # -> Keys, ValuesA
item_36 = ListItem(List=sort_19.ValuesA, Index=0, Wrap=True)
check_same_points_5 = CheckSamePoints(archPoint=pln_19, crvPoint=flatten(item_36))  # -> out, specialPt; inputs archPoint: list of Point3d, crvPoint: list of Point3d; same code as testpoint
item_37 = ListItem(List=pln_19, Index=check_same_points_5.specialPt, Wrap=True)
deplane_26 = DeconstructPlane(Plane=item_37)  # -> Origin, XAxis, YAxis, ZAxis
amp_19 = Amplitude(Vector=deplane_26.YAxis, Amplitude=expr("-x", Slider(5000, range=0..10000)))
move_30 = Move(Geometry=deplane_26.Origin, Motion=amp_19)  # -> Geometry, Transform
ln_30 = Line(StartPoint=deplane_26.Origin, EndPoint=move_30.Geometry)
ccx_20 = CurveCurve(CurveA=graft(ln_30), CurveB=flatten(merge_5))  # -> Points, ParamsA, ParamsB
shift = ShiftPaths(Data=ccx_20.Points, Offset=-1)
sort_20 = SortList(Keys=shift, ValuesA=shift)  # -> Keys, ValuesA
item_38 = ListItem(List=sort_20.ValuesA, Index=0, Wrap=True)
null_10 = NullItem(Item=flatten(item_38))  # -> NullFlags, InvalidFlags, Description
dispatch_36 = Dispatch(List=item_38, DispatchPattern=item_38)  # -> ListA, ListB
dispatch_37 = Dispatch(List=item_37, DispatchPattern=null_10.InvalidFlags)  # -> ListA, ListB
data_52 = Data(dispatch_37.ListB)
data_53 = Data(dispatch_36.ListA)

cull_i_16 = CullIndex(List=pln_19, Indices=check_same_points_5.specialPt, Wrap=True)
merge_18 = Merge(Data1=dispatch_34.ListA, Data2=cull_i_16)

# ----
# 1.1有檐口线
pln_20 = Plane(merge_18)

# ----
# 1.0无檐口线
# 与梁不相交
disc_14 = Discontinuity(Curve=merge_5, Level=1)  # -> Points, Parameters
pln_21 = Plane(dispatch_37.ListA)
pull_28 = PullPoint(Point=pln_21, Geometry=flatten(disc_14.Points), ClosestOnly=True)  # -> ClosestPoint, Distance
check_same_points_6 = CheckSamePoints(archPoint=flatten(disc_14.Points), crvPoint=pull_28.ClosestPoint)  # -> out, specialPt; inputs archPoint: list of Point3d, crvPoint: list of Point3d; same code as testpoint
item_39 = ListItem(List=flatten(disc_14.Points), Index=check_same_points_6.specialPt, Wrap=True)
cull_i_17 = CullIndex(List=flatten(disc_14.Points), Indices=check_same_points_6.specialPt, Wrap=True)
pull_29 = PullPoint(Point=item_39, Geometry=cull_i_17, ClosestOnly=True)  # -> ClosestPoint, Distance
pt_34 = Point(item_39)
pt_35 = Point(pull_29.ClosestPoint)
ln_31 = Line(StartPoint=pt_34, EndPoint=pt_35)
number_slider_29 = Slider(500, range=0..1000)
midpt_24 = CurveMiddle(Curve=ln_31)
deplane_27 = DeconstructPlane(Plane=pln_21)  # -> Origin, XAxis, YAxis, ZAxis
amp_20 = Amplitude(Vector=deplane_27.XAxis, Amplitude=number_slider_29)
amp_21 = Amplitude(Vector=deplane_27.XAxis, Amplitude=expr("-x", number_slider_29))
move_31 = Move(Geometry=midpt_24, Motion=amp_20)  # -> Geometry, Transform
move_32 = Move(Geometry=midpt_24, Motion=amp_21)  # -> Geometry, Transform
entwine_13 = Entwine(Branch00=deplane_27.Origin, Branch01=deplane_27.Origin, FlattenInputs=True)
entwine_14 = Entwine(Branch00=move_31.Geometry, Branch01=move_32.Geometry, FlattenInputs=True)

number_slider_30 = Slider(1000, range=0..1000)
number_slider_31 = Slider(3000, range=0..10000)
deplane_28 = DeconstructPlane(Plane=pln_20)  # -> Origin, XAxis, YAxis, ZAxis
amp_22 = Amplitude(Vector=deplane_28.YAxis, Amplitude=expr("-x", number_slider_30))
amp_23 = Amplitude(Vector=deplane_28.YAxis, Amplitude=number_slider_31)
move_33 = Move(Geometry=deplane_28.Origin, Motion=amp_22)  # -> Geometry, Transform
move_34 = Move(Geometry=deplane_28.Origin, Motion=amp_23)  # -> Geometry, Transform

# ----
# 定位点生成定位线
ln_32 = Line(StartPoint=move_33.Geometry, EndPoint=move_34.Geometry)

# ----
# 1.0无檐口线+上下层幕墙边线连续
# 01：钢板焊埋件[钢梁外侧]
# @钢边梁宽@钢边梁高
move2pt_16 = MoveToPoint(Geometry=data_52, PointA=data_52, PointB=data_53)  # -> Moved, Vector, Transform
move2pt_17 = MoveToPoint(Geometry=pln_21, PointA=entwine_13, PointB=entwine_14)  # -> Moved, Vector, Transform

# ----
# 1.1.1与梁不相交
ccx_21 = CurveCurve(CurveA=graft(ln_32), CurveB=line)  # -> Points, ParamsA, ParamsB
pull_30 = PullPoint(Point=ccx_21.Points, Geometry=deplane_28.Origin, ClosestOnly=True)  # -> flatten(ClosestPoint), Distance
cullduppoints_5 = RemoveDuplicatePoints(InputPoints=pull_30.ClosestPoint, Tolerance=0.001)  # -> OutputPoints, FirstPointIndexes
null_11 = NullItem(Item=cullduppoints_5.OutputPoints)  # -> NullFlags, InvalidFlags, Description
dispatch_38 = Dispatch(List=cullduppoints_5.OutputPoints, DispatchPattern=null_11.InvalidFlags)  # -> ListA, ListB
data_54 = Data(dispatch_38.ListB)
check_same_points_7 = CheckSamePoints(archPoint=deplane_28.Origin, crvPoint=data_54)  # -> out, specialPt; inputs archPoint: list of Point3d, crvPoint: list of Point3d; same code as testpoint
item_40 = ListItem(List=pln_20, Index=check_same_points_7.specialPt, Wrap=True)
deplane_29 = DeconstructPlane(Plane=item_40)  # -> Origin, XAxis, YAxis, ZAxis
amp_24 = Amplitude(Vector=deplane_29.YAxis, Amplitude=expr("-x", number_slider_30))
amp_25 = Amplitude(Vector=deplane_29.YAxis, Amplitude=number_slider_31)
move_35 = Move(Geometry=deplane_29.Origin, Motion=amp_24)  # -> Geometry, Transform
move_36 = Move(Geometry=deplane_29.Origin, Motion=amp_25)  # -> Geometry, Transform
ln_33 = Line(StartPoint=move_35.Geometry, EndPoint=move_36.Geometry)
ccx_22 = CurveCurve(CurveA=graft(ln_33), CurveB=line)  # -> flatten(Points), ParamsA, ParamsB
cullduppoints_6 = RemoveDuplicatePoints(InputPoints=ccx_22.Points, Tolerance=0.001)  # -> OutputPoints, FirstPointIndexes
null_12 = NullItem(Item=cullduppoints_6.OutputPoints)  # -> NullFlags, InvalidFlags, Description
dispatch_39 = Dispatch(List=cullduppoints_6.OutputPoints, DispatchPattern=null_12.NullFlags)  # -> ListA, ListB
pt_36 = Point(dispatch_39.ListB)
pull_31 = PullPoint(Point=deplane_29.Origin, Geometry=pt_36, ClosestOnly=True)  # -> ClosestPoint, Distance

# ----
# 1.1.1与梁相交
ccx_23 = CurveCurve(CurveA=graft(ln_32), CurveB=crv_26)  # -> Points, ParamsA, ParamsB
pull_32 = PullPoint(Point=ccx_23.Points, Geometry=deplane_28.Origin, ClosestOnly=True)  # -> flatten(ClosestPoint), Distance
check_same_points_8 = CheckSamePoints(archPoint=deplane_28.Origin, crvPoint=pull_32.ClosestPoint)  # -> out, specialPt; inputs archPoint: list of Point3d, crvPoint: list of Point3d; same code as testpoint
item_41 = ListItem(List=pln_20, Index=check_same_points_8.specialPt, Wrap=True)
deplane_30 = DeconstructPlane(Plane=item_41)  # -> Origin, XAxis, YAxis, ZAxis
amp_26 = Amplitude(Vector=deplane_30.YAxis, Amplitude=expr("-x", number_slider_30))
amp_27 = Amplitude(Vector=deplane_30.YAxis, Amplitude=number_slider_31)
move_37 = Move(Geometry=deplane_30.Origin, Motion=amp_26)  # -> Geometry, Transform
move_38 = Move(Geometry=deplane_30.Origin, Motion=amp_27)  # -> Geometry, Transform
ln_34 = Line(StartPoint=move_37.Geometry, EndPoint=move_38.Geometry)
ccx_24 = CurveCurve(CurveA=graft(ln_34), CurveB=crv_26)  # -> flatten(Points), ParamsA, ParamsB
cullduppoints_7 = RemoveDuplicatePoints(InputPoints=ccx_24.Points, Tolerance=0.001)  # -> OutputPoints, FirstPointIndexes
null_13 = NullItem(Item=cullduppoints_7.OutputPoints)  # -> NullFlags, InvalidFlags, Description
dispatch_40 = Dispatch(List=cullduppoints_7.OutputPoints, DispatchPattern=null_13.NullFlags)  # -> ListA, ListB
pt_37 = Point(dispatch_40.ListB)
pull_33 = PullPoint(Point=deplane_30.Origin, Geometry=pt_37, ClosestOnly=True)  # -> ClosestPoint, Distance

# ----
# 1.1.1定位点
# 与梁相交
move2pt_18 = MoveToPoint(Geometry=item_41, PointA=deplane_30.Origin, PointB=pull_33.ClosestPoint)  # -> Moved, Vector, Transform

# ----
# 1.1.1定位点
# 与梁不相交
# 如何处理？？
move2pt_19 = MoveToPoint(Geometry=item_40, PointA=deplane_29.Origin, PointB=pull_31.ClosestPoint)  # -> Moved, Vector, Transform

# ----
# 1.1.1布埋件
data_55 = Data(move2pt_18.Moved)

# ----
# 1.1.2布埋件
data_56 = Data(move2pt_19.Moved)

pln_22 = Plane(move2pt_18.Moved)
deplane_31 = DeconstructPlane(Plane=pln_22)  # -> Origin, XAxis, YAxis, ZAxis
amp_28 = Amplitude(Vector=deplane_31.YAxis, Amplitude=expr("-x", addition_3))
move_39 = Move(Geometry=deplane_31.Origin, Motion=amp_28)  # -> Geometry, Transform
move2pt_20 = MoveToPoint(Geometry=pln_22, PointA=deplane_31.Origin, PointB=move_39.Geometry)  # -> Moved, Vector, Transform
incurve_2 = PointInCurve(Point=move_39.Geometry, Curve=crv_39)  # -> Relationship, Point
equals_4 = Equality(FirstNumber=incurve_2.Relationship, SecondNumber="0")  # -> Equality, Inequality
dispatch_41 = Dispatch(List=move2pt_20.Moved, DispatchPattern=equals_4.Equality)  # -> ListA, ListB
pln_23 = Plane(dispatch_41.ListB)

# ----
# 1.2.1梁以内>350
# 
# 侧埋，钢板焊
pln_24 = Plane(dispatch_41.ListA)

pln_25 = Plane(pln_20)
number_slider_32 = Slider(3584, range=0..10000)
deplane_32 = DeconstructPlane(Plane=pln_25)  # -> Origin, XAxis, YAxis, ZAxis
amp_29 = Amplitude(Vector=deplane_32.YAxis, Amplitude=number_slider_32)
amp_30 = Amplitude(Vector=deplane_32.YAxis, Amplitude=expr("-x", number_slider_32))
move_40 = Move(Geometry=deplane_32.Origin, Motion=amp_30)  # -> Geometry, Transform
move_41 = Move(Geometry=deplane_32.Origin, Motion=amp_29)  # -> Geometry, Transform
ln_35 = Line(StartPoint=move_40.Geometry, EndPoint=move_41.Geometry)
ccx_25 = CurveCurve(CurveA=ln_35, CurveB=offset_9)  # -> Points, ParamsA, ParamsB
ccx_26 = CurveCurve(CurveA=ln_35, CurveB=offset_10)  # -> Points, ParamsA, ParamsB
ln_36 = Line(StartPoint=ccx_25.Points, EndPoint=ccx_26.Points)  # -> flatten(Line)
len_8 = Length(Curve=ln_36)
sort_21 = SortList(Keys=len_8)  # -> Keys, ValuesA
larger_11 = LargerThan(FirstNumber=len_8, SecondNumber=number_slider_13)  # -> LargerThan, OrEqualTo
panel_47 = Panel(sort_21.Keys)
dispatch_42 = Dispatch(List=ln_36, DispatchPattern=larger_11.LargerThan)  # -> ListA, ListB
line_2 = Line(dispatch_42.ListA)
line_3 = Line(dispatch_42.ListB)
ccx_27 = CurveCurve(CurveA=line_3, CurveB=merge_6)  # -> Points, ParamsA, ParamsB
pt_38 = Point(flatten(ccx_27.Points))
pull_34 = PullPoint(Point=deplane_32.Origin, Geometry=graft(pt_38), ClosestOnly=True)  # -> ClosestPoint, Distance
sort_22 = SortList(Keys=pull_34.Distance, ValuesA=pln_25)  # -> Keys, ValuesA
item_42 = ListItem(List=sort_22.ValuesA, Index=0, Wrap=True)  # -> flatten(Item)
check_same_points_9 = CheckSamePoints(archPoint=pln_25, crvPoint=item_42)  # -> out, specialPt; inputs archPoint: list of Point3d, crvPoint: list of Point3d; same code as testpoint
item_43 = ListItem(List=pln_25, Index=check_same_points_9.specialPt, Wrap=True)
deplane_33 = DeconstructPlane(Plane=item_43)  # -> Origin, XAxis, YAxis, ZAxis

pln_26 = Plane(pln_25)
number_slider_33 = Slider(3584, range=0..10000)
deplane_34 = DeconstructPlane(Plane=pln_26)  # -> Origin, XAxis, YAxis, ZAxis
amp_31 = Amplitude(Vector=deplane_34.YAxis, Amplitude=number_slider_33)
amp_32 = Amplitude(Vector=deplane_34.YAxis, Amplitude=expr("-x", number_slider_33))
move_42 = Move(Geometry=deplane_34.Origin, Motion=amp_32)  # -> Geometry, Transform
move_43 = Move(Geometry=deplane_34.Origin, Motion=amp_31)  # -> Geometry, Transform
ln_37 = Line(StartPoint=move_42.Geometry, EndPoint=move_43.Geometry)
ccx_28 = CurveCurve(CurveA=ln_37, CurveB=offset_11)  # -> Points, ParamsA, ParamsB
ccx_29 = CurveCurve(CurveA=ln_37, CurveB=offset_12)  # -> Points, ParamsA, ParamsB
ln_38 = Line(StartPoint=ccx_28.Points, EndPoint=ccx_29.Points)  # -> flatten(Line)
len_9 = Length(Curve=ln_38)
sort_23 = SortList(Keys=len_9)  # -> Keys, ValuesA
panel_48 = Panel(sort_23.Keys)
larger_12 = LargerThan(FirstNumber=len_9, SecondNumber=number_slider_14)  # -> LargerThan, OrEqualTo
dispatch_43 = Dispatch(List=ln_38, DispatchPattern=larger_12.LargerThan)  # -> ListA, ListB
line_4 = Line(dispatch_43.ListA)
line_5 = Line(dispatch_43.ListB)
ccx_30 = CurveCurve(CurveA=line_5, CurveB=merge_5)  # -> Points, ParamsA, ParamsB
pt_39 = Point(flatten(ccx_30.Points))
pull_35 = PullPoint(Point=deplane_34.Origin, Geometry=graft(pt_39), ClosestOnly=True)  # -> ClosestPoint, Distance
sort_24 = SortList(Keys=pull_35.Distance, ValuesA=pln_26)  # -> Keys, ValuesA
item_44 = ListItem(List=sort_24.ValuesA, Index=0, Wrap=True)  # -> flatten(Item)
check_same_points_10 = CheckSamePoints(archPoint=pln_26, crvPoint=item_44)  # -> out, specialPt; inputs archPoint: list of Point3d, crvPoint: list of Point3d; same code as testpoint
item_45 = ListItem(List=pln_26, Index=check_same_points_10.specialPt, Wrap=True)
deplane_35 = DeconstructPlane(Plane=item_45)  # -> Origin, XAxis, YAxis, ZAxis
pull_36 = PullPoint(Point=item_45, Geometry=pt_39, ClosestOnly=True)  # -> ClosestPoint, Distance

pull_37 = PullPoint(Point=deplane_33.Origin, Geometry=pt_38, ClosestOnly=True)  # -> ClosestPoint, Distance

# ----
# 1.2.2
# 下层建筑边线外侧50-350mm
# 03：钢板焊埋件[钢梁内侧]
# @钢边梁宽@钢边梁高
move2pt_21 = MoveToPoint(Geometry=item_43, PointA=deplane_33.Origin, PointB=pull_37.ClosestPoint)  # -> Moved, Vector, Transform

# ----
# 1.2.3
# 下层建筑边线内侧300-600mm范围
# 03：钢板焊埋件[钢梁外侧]
# @钢边梁宽@钢边梁高
move2pt_22 = MoveToPoint(Geometry=item_45, PointA=deplane_35.Origin, PointB=pull_36.ClosestPoint)  # -> Moved, Vector, Transform

# ----
# 3.1下层建筑内侧到300到外侧50内是否有钢结构
cull_i_18 = CullIndex(List=pln_26, Indices=check_same_points_10.specialPt, Wrap=True)
cull_i_19 = CullIndex(List=pln_25, Indices=check_same_points_9.specialPt, Wrap=True)
deplane_36 = DeconstructPlane(Plane=cull_i_18)  # -> Origin, XAxis, YAxis, ZAxis
deplane_37 = DeconstructPlane(Plane=cull_i_19)  # -> Origin, XAxis, YAxis, ZAxis
check_same_points_11 = CheckSamePoints(archPoint=deplane_36.Origin, crvPoint=deplane_37.Origin)  # -> out, specialPt; inputs archPoint: list of Point3d, crvPoint: list of Point3d; same code as testpoint

# ----
# 同时满足N
item_46 = ListItem(List=cull_i_18, Index=check_same_points_11.specialPt, Wrap=True)

# ----
# 不同时满足N
cull_i_20 = CullIndex(List=cull_i_18, Indices=check_same_points_11.specialPt, Wrap=True)

# ----
# 3.3上层建筑边线,
# 默认建筑提供上翻，如主结构提供示意则使用结构定位【该项目无】，
# 如无则使用建筑边线向内50mm作为埋件定位
crv_64 = Curve(crv_11)
merge_19 = Merge(Data1=item_46, Data2=cull_i_20)  # -> flatten(Result)
offset_20 = OffsetCurve(Curve=crv_64, Distance=expr("-x", Slider(50, range=0..100)), Corners=1)
pln_27 = Plane(merge_19)
number_slider_34 = Slider(3584, range=0..10000)
deplane_38 = DeconstructPlane(Plane=pln_27)  # -> Origin, XAxis, YAxis, ZAxis
amp_33 = Amplitude(Vector=deplane_38.YAxis, Amplitude=number_slider_34)
amp_34 = Amplitude(Vector=deplane_38.YAxis, Amplitude=expr("-x", number_slider_34))
move_44 = Move(Geometry=deplane_38.Origin, Motion=amp_34)  # -> Geometry, Transform
move_45 = Move(Geometry=deplane_38.Origin, Motion=amp_33)  # -> Geometry, Transform
ln_39 = Line(StartPoint=move_44.Geometry, EndPoint=move_45.Geometry)
ccx_31 = CurveCurve(CurveA=ln_39, CurveB=offset_20)  # -> flatten(Points), ParamsA, ParamsB
pull_38 = PullPoint(Point=deplane_38.Origin, Geometry=ccx_31.Points, ClosestOnly=True)  # -> ClosestPoint, Distance

# ----
# 3.3上层建筑边线,
# 默认建筑提供上翻
# 04：板埋埋件[混凝土楼板上侧]@板埋参数xn
move2pt_23 = MoveToPoint(Geometry=pln_27, PointA=deplane_38.Origin, PointB=pull_38.ClosestPoint)  # -> Moved, Vector, Transform

# ---- group: 大面
# 大面埋件布置
number_slider_35 = Slider(0.002, range=0..0.01)
filter_21 = StreamFilter(Gate=list_2, Stream0=expression_4, Stream1=number_slider_35)
filter_22 = StreamFilter(Gate=list, Stream0=filter_21, Stream1=expression_4, Stream2=filter_21)
offset_21 = OffsetCurve(Curve=offset, Distance=expr("-x", filter_22), Plane=PlaneXY(0, 0, 0), Corners=1)

# ---- group: 阴阳角区分 (continued)
crv_cp_7 = CurveClosestPoint(Point=item_17, Curve=offset_21)  # -> Point, Parameter, Distance
vec2pt_2 = Vector2Pt(PointA=crv_cp_7.Point, PointB=crv_cp_3.Point, Unitize=False)  # -> expr("-x", Vector), Length
angle_4 = Angle(VectorA=eval_3.Tangent, VectorB=vec2pt_2.Vector)  # -> Angle, Reflex
deg_7 = Degrees(Radians=angle_4.Angle)
smaller_10 = SmallerThan(FirstNumber=deg_7, SecondNumber=89)  # -> SmallerThan, OrEqualTo
dispatch_44 = Dispatch(List=item_17, DispatchPattern=smaller_10.SmallerThan)  # -> ListA, ListB

# ---- group: 正常+阳角+阴角区分 (continued)
data_57 = Data(dispatch_44.ListA)
data_58 = Data(dispatch_44.ListB)
pull_39 = PullPoint(Point=data_57, Geometry=crv_48, ClosestOnly=True)  # -> ClosestPoint, Distance
pull_40 = PullPoint(Point=data_58, Geometry=crv_49, ClosestOnly=True)  # -> ClosestPoint, Distance
c_script_3 = CSharpScript(archPoint=pull_39.ClosestPoint, crvPoint=explode_5.Vertices)  # -> out, specialPt; inputs archPoint: list of Point3d, crvPoint: list of Point3d; same code as testpoint
c_script_4 = CSharpScript(archPoint=pull_40.ClosestPoint, crvPoint=explode_6.Vertices)  # -> out, specialPt; inputs archPoint: list of Point3d, crvPoint: list of Point3d; same code as testpoint
cull_i_21 = CullIndex(List=data_57, Indices=c_script_3.specialPt, Wrap=True)

# ---- group: 阴角定位-细化 (continued)
dispatch_45 = Dispatch(List=item_24, DispatchPattern=smaller_10.SmallerThan)  # -> ListA, ListB
item_47 = ListItem(List=dispatch_45.ListB, Index=c_script_4.specialPt, Wrap=True)
join_4 = JoinCurves(Curves=item_47, Preserve=False)
explode_9 = Explode(Curve=join_4, Recursive=True)  # -> Segments, Vertices
crv_65 = Curve(simplify(explode_9.Segments))
len_10 = Length(Curve=crv_65)
sort_25 = SortList(Keys=len_10, ValuesA=crv_65)  # -> Keys, ValuesA
item_48 = ListItem(List=sort_25.ValuesA, Index=0, Wrap=True)  # -> Item2, Item1, Item
crv_66 = Curve([item_48.Item2, item_48.Item1])
disc_15 = Discontinuity(Curve=crv_66, Level=1)  # -> Points, Parameters
item_49 = ListItem(List=disc_15.Points, Index=0, Wrap=True)
pull_41 = PullPoint(Point=disc_15.Points, Geometry=pt_2, ClosestOnly=True)  # -> ClosestPoint, Distance
crv_cp_8 = CurveClosestPoint(Point=disc_15.Points, Curve=offset)  # -> Point, Parameter, Distance
sort_26 = SortList(Keys=pull_41.Distance, ValuesA=crv_cp_8.Point)  # -> Keys, ValuesA

# ---- group: 正常+阳角+阴角区分 / 正常-遗漏
cull_i_22 = CullIndex(List=data_58, Indices=c_script_4.specialPt, Wrap=True)

# ---- group: 正常+阳角+阴角区分 / 阴角定位点
item_50 = ListItem(List=data_58, Index=c_script_4.specialPt, Wrap=True)

# ---- group: 正常+阳角+阴角区分 / 正常定位点
merge_20 = Merge(Data1=cull_i_7, Data2=cull_i_22, Data3=cull_i_21)

# ---- group: 正常+阳角+阴角区分 / 阳角定位点
item_51 = ListItem(List=data_57, Index=c_script_3.specialPt, Wrap=True)

# ---- group: 阴角定位-细化 / 阴角-2点定位
item_52 = ListItem(List=sort_26.ValuesA, Index=0, Wrap=True)

# ----
# 阳角埋件布置
pt_40 = Point(item_51)
explode_10 = Explode(Curve=crv_23, Recursive=True)  # -> Segments, Vertices
cp_2 = ClosestPoint(Point=pt_40, Cloud=explode_10.Vertices)  # -> ClosestPoint, CPIndex, Distance
cir_3 = Circle(Plane=cp_2.ClosestPoint, Radius=Slider(150, range=0..1000))
pt_41 = Point(cp_2.ClosestPoint)
ccx_32 = CurveCurve(CurveA=cir_3, CurveB=offset)  # -> Points, ParamsA, ParamsB
item_53 = ListItem(List=ccx_32.Points, Index=0, Wrap=True)  # -> Item, Item1
ln_40 = Line(StartPoint=graft(pt_41), EndPoint=graft(item_53.Item))  # -> flatten(Line)
ln_41 = Line(StartPoint=graft(pt_41), EndPoint=graft(item_53.Item1))  # -> flatten(Line)
item_54 = ListItem(List=filter_15, Index="1", Wrap=True)
pl_8 = ConstructPlane(Origin=pt_41, XAxis=ln_40, YAxis=ln_41)
bbox_6 = BoundingBox(Content=graft(item_54), Plane=PlaneXY(0, 0, 0))  # -> Box, Box_2
srf = Surface(bbox_6.Box)
explode_11 = Explode(Curve=srf, Recursive=True)  # -> Segments, Vertices
item_55 = ListItem(List=explode_11.Vertices, Index=0, Wrap=True)  # -> Item, Item1, Item2
ln_42 = Line(StartPoint=graft(item_55.Item1), EndPoint=graft(item_55.Item2))
ln_43 = Line(StartPoint=graft(item_55.Item1), EndPoint=graft(item_55.Item))
ln_44 = Line(StartPoint=graft(item_55.Item1), EndPoint=graft(item_55.Item))
ln_45 = Line(StartPoint=graft(item_55.Item1), EndPoint=graft(item_55.Item2))
pl_9 = ConstructPlane(Origin=item_55.Item1, XAxis=ln_45, YAxis=ln_44)
pl_10 = ConstructPlane(Origin=item_55.Item1, XAxis=ln_43, YAxis=ln_42)
orient_6 = Orient(Geometry=item_54, Source=pl_10, Target=pl_8)  # -> Geometry, Transform
orient_7 = Orient(Geometry=item_54, Source=pl_9, Target=pl_8)  # -> Geometry, Transform
merge_21 = Merge(Data1=orient_6.Geometry, Data2=orient_7.Geometry)
filter_23 = StreamFilter(Gate=list_2, Stream0=orient_6.Geometry, Stream1=merge_21)
bbox_7 = BoundingBox(Content=filter_23, Plane=PlaneXY(0, 0, 0))  # -> Box, Box_2
entwine_15 = Entwine(Branch00=filter_23, Branch01=bbox_7.Box, FlattenInputs=True)
flip_3 = FlipMatrix(Data=entwine_15)
item_56 = ListItem(List=flip_3, Index=-1, Wrap=True)  # -> flatten(Item)
item_57 = ListItem(List=flip_3, Index="0", Wrap=True)  # -> flatten(Item)

# ---- group: 阴角
# 阴角埋件布置
# Rhino 文件中导入的块名
explode_12 = Explode(Curve=crv_23, Recursive=True)  # -> Segments, Vertices
cp_3 = ClosestPoint(Point=item_50, Cloud=explode_12.Vertices)  # -> ClosestPoint, CPIndex, Distance
pshift_6 = ShiftPaths(Data=item_52, Offset=-1)
crv_cp_9 = CurveClosestPoint(Point=pshift_6, Curve=offset_21)  # -> Point, Parameter, Distance
crv_cp_10 = CurveClosestPoint(Point=pshift_6, Curve=offset)  # -> Point, Parameter, Distance
vec2pt_3 = Vector2Pt(PointA=crv_cp_9.Point, PointB=crv_cp_10.Point, Unitize=False)  # -> expr("-x", Vector), Length
eval_7 = EvaluateCurve(Curve=offset, Parameter=crv_cp_10.Parameter)  # -> Point, Tangent, Angle
pl_11 = ConstructPlane(Origin=crv_cp_10.Point, XAxis=eval_7.Tangent, YAxis=vec2pt_3.Vector)
orient_8 = Orient(Geometry=block, Source=PlaneXY(0, 0, 0), Target=pl_11)  # -> Geometry, Transform

# ---- group: 大面 (continued)
crv_cp_11 = CurveClosestPoint(Point=merge_20, Curve=offset_21)  # -> Point, Parameter, Distance
crv_cp_12 = CurveClosestPoint(Point=merge_20, Curve=offset)  # -> Point, Parameter, Distance
vec2pt_4 = Vector2Pt(PointA=crv_cp_11.Point, PointB=crv_cp_12.Point, Unitize=False)  # -> expr("-x", Vector), Length
eval_8 = EvaluateCurve(Curve=offset, Parameter=crv_cp_12.Parameter)  # -> Point, Tangent, Angle
pl_12 = ConstructPlane(Origin=crv_cp_12.Point, XAxis=eval_8.Tangent, YAxis=vec2pt_4.Vector)
orient_9 = Orient(Geometry=block, Source=PlaneXY(0, 0, 0), Target=pl_12)  # -> flatten(Geometry), Transform

# ---- group: Datea / 2
lng_5 = ListLength(List=orient_9.Geometry)
division_10 = Division(A=lng_5, B=2)
split_2 = SplitList(List=orient_9.Geometry, Index=division_10)  # -> ListA, ListB
data_59 = Data(split_2.ListA)

# ----
bbox_8 = BoundingBox(Content=data_59, Plane=PlaneXY(0, 0, 0))  # -> Box, Box_2
entwine_16 = Entwine(Branch00=data_59, Branch01=bbox_8.Box, FlattenInputs=True)
flip_4 = FlipMatrix(Data=entwine_16)
item_58 = ListItem(List=flip_4, Index=-1, Wrap=True)  # -> flatten(Item)
item_59 = ListItem(List=flip_4, Index="0", Wrap=True)  # -> flatten(Item)
阴角 = Geometry(orient_8.Geometry)

# ---- group: Monomer + Side/Top / Monomer Type
filter_24 = StreamFilter(Gate=list, Stream0=item_56, Stream1=item_56, Stream2=item_56)

# ----
# 槽埋-角部倾斜时
bbox_9 = BoundingBox(Content=item_56, Plane=PlaneXY(0, 0, 0))  # -> Box, Box_2
ln_46 = Line(StartPoint=pt_40, EndPoint=pt_41)
debrep = DeconstructBrep(Brep=bbox_9.Box)  # -> Faces, Edges, Vertices
deplane_39 = DeconstructPlane(Plane=ln_46)  # -> Origin, XAxis, YAxis, ZAxis
len_11 = Length(Curve=debrep.Edges)
sort_27 = SortList(Keys=len_11, ValuesA=debrep.Edges)  # -> Keys, reverse(ValuesA)
amp_35 = Amplitude(Vector=deplane_39.XAxis, Amplitude=Slider(63.5, range=10..100))
item_60 = ListItem(List=sort_27.ValuesA, Index=0, Wrap=True)  # -> Item, Item1, Item2
item_61 = ListItem(List=sort_27.ValuesA, Index=0, Wrap=True)
move_46 = Move(Geometry=deplane_39.Origin, Motion=amp_35)  # -> Geometry, Transform
len_12 = Length(Curve=item_61)
end_9 = EndPoints(Curve=item_60.Item2)  # -> Start, End
end_10 = EndPoints(Curve=item_60.Item1)  # -> Start, End
ln_47 = Line(StartPoint=deplane_39.Origin, EndPoint=move_46.Geometry)
ln_48 = Line(StartPoint=move_46.Geometry, EndPoint=deplane_39.Origin)
avr = Average(Input=[end_10.Start, end_10.End])
ln_49 = Line(StartPoint=end_9.Start, EndPoint=end_9.End)
ln_50 = Line(StartPoint=end_10.Start, EndPoint=avr)
c_script_5 = CSharpScript(iReset=Toggle(True), turns=Slider(30, range=0..100), steps=Slider(10, range=0..10))  # -> out, num; inputs numDefault: Double, iReset: Boolean, turns: Int32, steps: Double
# ---------- c_script_5: C# ----------
    if(iReset){
      number = 0;}

    for(int i = 0; i < turns;i++){
      number = number + steps;
      numStore.Add(number);
      Print(number.ToString());}

    num = numStore;
# ---------- c_script_5: C# additional code ----------
  double number = 0;
  List <double> numStore = new List<double>();
# ---------- end c_script_5 ----------
pl_13 = ConstructPlane(Origin=avr, XAxis=ln_50, YAxis=ln_49)
panel_49 = Panel(c_script_5.num)
amp_36 = Amplitude(Vector=ln_46, Amplitude=graft(c_script_5.num))

item_62 = ListItem(List=flatten(len_12), Index=0, Wrap=True)

ln_51 = Line(StartPoint=pt_40, EndPoint=pt_41)
move_47 = Move(Geometry=pt_41, Motion=ln_51)  # -> Geometry, Transform
ccx_33 = CurveCurve(CurveA=cir_3, CurveB=offset)  # -> Points, ParamsA, ParamsB
item_63 = ListItem(List=ccx_33.Points, Index=0, Wrap=True)  # -> flatten(Item), flatten(Item1)
ln_52 = Line(StartPoint=pt_41, EndPoint=item_63.Item)
ln_53 = Line(StartPoint=pt_41, EndPoint=move_47.Geometry)
ln_54 = Line(StartPoint=pt_41, EndPoint=item_63.Item1)
angle_5 = Angle(VectorA=ln_52, VectorB=ln_53)  # -> Angle, Reflex
angle_6 = Angle(VectorA=ln_54, VectorB=ln_53)  # -> Angle, Reflex
deg_8 = Degrees(Radians=angle_5.Angle)
deg_9 = Degrees(Radians=angle_6.Angle)
item_64 = ListItem(List=ln_53, Index=Slider(3, range=0..4), Wrap=True)
tan = Tangent(Value=degrees(deg_8))
entwine_17 = Entwine(Branch00=ln_52, Branch01=tan, FlattenInputs=True)
tan_2 = Tangent(Value=degrees(deg_9))
division_11 = Division(A=tan, B=tan_2)
panel_50 = Panel(deg_9)
panel_51 = Panel(deg_8)
addition_8 = Addition(A=division_11, B=1)
division_12 = Division(A="1", B=addition_8)
subtraction = Subtraction(A="1", B=division_12)
num = Number(division_12)
larger_13 = LargerThan(FirstNumber=tan, SecondNumber=tan_2)  # -> LargerThan, OrEqualTo

amp_37 = Amplitude(Vector=ln_48, Amplitude=expr("x/2", flatten(item_62)))
amp_38 = Amplitude(Vector=ln_47, Amplitude=expr("x/2", flatten(item_62)))
move_48 = Move(Geometry=pt_41, Motion=amp_37)  # -> Geometry, Transform
move_49 = Move(Geometry=pt_41, Motion=amp_38)  # -> Geometry, Transform
ln_55 = Line(StartPoint=move_48.Geometry, EndPoint=move_49.Geometry)

crv_67 = Curve(ln_55)
mp = Midpoint(Curve=crv_67)
eval_9 = EvaluateCurve(Curve=crv_67, Parameter=subtraction)  # -> Point, Tangent, Angle
eval_10 = EvaluateCurve(Curve=crv_67, Parameter=num)  # -> Point, Tangent, Angle
dispatch_46 = Dispatch(List=eval_9.Point, DispatchPattern=larger_13.OrEqualTo)  # -> ListA, ListB
dispatch_47 = Dispatch(List=eval_10.Point, DispatchPattern=larger_13.OrEqualTo)  # -> ListA, ListB
pt_42 = Point(dispatch_46.ListB)
pt_43 = Point(dispatch_47.ListA)
merge_22 = Merge(Data1=pt_43, Data2=pt_42)
pull_42 = PullPoint(Point=merge_22, Geometry=graft(mp), ClosestOnly=True)  # -> ClosestPoint, Distance
panel_52 = Panel(merge_22)
sort_28 = SortList(Keys=pull_42.Distance, ValuesA=merge_22)  # -> Keys, ValuesA
item_65 = ListItem(List=sort_28.ValuesA, Index=0, Wrap=True)  # -> flatten(Item)
ln_56 = Line(StartPoint=item_65, EndPoint=mp)
panel_53 = Panel(item_65)
move_50 = Move(Geometry=crv_67, Motion=ln_56)  # -> Geometry, Transform

# ---- group: 正常和阳角 - BoundingBox — 测Intersection
entwine_18 = Entwine(Branch00=flip.Curve, Branch01=offset, FlattenInputs=True)
flip_5 = FlipMatrix(Data=entwine_18)
item_66 = ListItem(List=flip_5, Index=0, Wrap=True)  # -> Item, Item1

# ----
move_51 = Move(Geometry=move_50.Geometry, Motion=amp_36)  # -> Geometry, Transform
ccx_34 = CurveCurve(CurveA=move_51.Geometry, CurveB=crv_23)  # -> Points, ParamsA, ParamsB
item_67 = ListItem(List=ccx_34.Points, Index=0, Wrap=True)
item_68 = ListItem(List=ccx_34.Points, Index="-1", Wrap=True)
pshift_7 = ShiftPaths(Data=item_67, Offset=-1)
pshift_8 = ShiftPaths(Data=item_68, Offset=-1)
flip_6 = FlipMatrix(Data=pshift_7)
flip_7 = FlipMatrix(Data=pshift_8)
pt_44 = Point(flip_6)
pt_45 = Point(flip_7)
pull_43 = PullPoint(Point=pt_44, Geometry=graft(mp), ClosestOnly=True)  # -> ClosestPoint, Distance
pull_44 = PullPoint(Point=pt_45, Geometry=graft(mp), ClosestOnly=True)  # -> ClosestPoint, Distance
sort_29 = SortList(Keys=pull_43.Distance, ValuesA=pt_44)  # -> Keys, ValuesA
sort_30 = SortList(Keys=pull_44.Distance, ValuesA=pt_45)  # -> Keys, ValuesA
item_69 = ListItem(List=sort_29.ValuesA, Index="-1", Wrap=True)
item_70 = ListItem(List=sort_30.ValuesA, Index="-1", Wrap=True)
ln_57 = Line(StartPoint=item_70, EndPoint=item_69)

end_11 = EndPoints(Curve=ln_57)  # -> Start, End

avr_2 = Average(Input=[end_11.Start, end_11.End])
pl_14 = ConstructPlane(Origin=avr_2, XAxis=ln_57, YAxis=graft(ln_46))
orient_10 = Orient(Geometry=graft(item_57), Source=pl_13, Target=pl_14)  # -> Geometry, Transform
orient_11 = Orient(Geometry=graft(item_56), Source=pl_13, Target=pl_14)  # -> Geometry, Transform

filter_25 = StreamFilter(Gate=list_8, Stream0=item_56, Stream1=orient_11.Geometry)

# ---- group: Monomer + Side/Top / Monomer Type (continued)
filter_26 = StreamFilter(Gate=list, Stream0=item_56, Stream1=filter_25, Stream2=item_56)

# ---- group: Monomer + Side/Top / Top/Side
filter_27 = StreamFilter(Gate=list_2, Stream0=filter_26, Stream1=filter_24)

# ----
filter_28 = StreamFilter(Gate=list_8, Stream0=item_57, Stream1=orient_10.Geometry)

# ---- group: 阳角分类
filter_29 = StreamFilter(Gate=list, Stream0=item_57, Stream1=filter_28, Stream2=item_57)
filter_30 = StreamFilter(Gate=list, Stream0=item_57, Stream1=item_57, Stream2=item_57)
filter_31 = StreamFilter(Gate=list_2, Stream0=filter_29, Stream1=filter_30)

# ----
阳角 = Geometry(filter_31)

# ---- group: 正常和阳角 - BoundingBox — 测Intersection (continued)
c_script_6 = CSharpScript(BrepMain=item_58, BrepStay=filter_27)  # -> out, BrepInters, BrepRemain, IndexM, IndexS; inputs BrepMain: list of Brep, BrepStay: list of Brep
# ---------- c_script_6: C# ----------
    List<Brep> BrepI = new List<Brep>();
    List<Brep> BrepR = new List<Brep>();
    List<int> num = new List<int>();
    List<int> numS = new List<int>();


    double tolr = Rhino.RhinoDoc.ActiveDoc.ModelAbsoluteTolerance;

    for(int j = 0; j < BrepMain.Count;j++){
      for(int i = 0; i < BrepStay.Count;i++){
        bool test = Rhino.Geometry.Intersect.Intersection.BrepBrep(BrepMain[j], BrepStay[i], tolr, out crv, out pts);
        if(test && crv.Length != 0){
          tryThis = true;
          numS.Add(i);
          break;}
        else{
          tryThis = false;}
      }
      if(tryThis){
        BrepI.Add(BrepMain[j]);
        num.Add(j);
      }
      else{
        BrepR.Add(BrepMain[j]);
      }
    }



    BrepInters = BrepI;
    BrepRemain = BrepR;
    IndexM = num;
    IndexS = numS;
# ---------- c_script_6: C# additional code ----------
  Rhino.Geometry.Curve[] crv;
  Rhino.Geometry.Point3d[] pts;
  bool tryThis;
# ---------- end c_script_6 ----------
item_71 = ListItem(List=item_58, Index=c_script_6.IndexM, Wrap=True)  # -> graft(Item)
item_72 = ListItem(List=filter_27, Index=c_script_6.IndexS, Wrap=True)  # -> graft(Item)
cull_i_23 = CullIndex(List=item_59, Indices=c_script_6.IndexM, Wrap=True)
item_73 = ListItem(List=item_59, Index=c_script_6.IndexM, Wrap=True)  # -> graft(Item)
area_14 = Area(Geometry=item_71)  # -> Area, Centroid
bbx = BrepBrep(BrepA=item_71, BrepB=item_72)  # -> simplify(Curves), Points
area_15 = Area(Geometry=bbx.Curves)  # -> Area, Centroid
ln_58 = Line(StartPoint=area_14.Centroid, EndPoint=area_15.Centroid)
mp_2 = Midpoint(Curve=ln_58)
scale_14 = Scale(Geometry=ln_58, Center=mp_2, Factor=Slider(1000000, range=0..1000000))  # -> Geometry, Transform
ccx_35 = CurveCurve(CurveA=scale_14.Geometry, CurveB=bbx.Curves)  # -> Points, ParamsA, ParamsB
item_74 = ListItem(List=ccx_35.Points, Index=0, Wrap=True)  # -> Item, Item1
ln_59 = Line(StartPoint=item_74.Item1, EndPoint=item_74.Item)
move_52 = Move(Geometry=item_73, Motion=ln_59)  # -> simplify(Geometry), Transform
bbox_10 = BoundingBox(Content=move_52.Geometry, Plane=PlaneXY(0, 0, 0))  # -> Box, Box_2

# ----
# 这里如果跑红也不要紧，
# 说明单体没有出现相撞的情况
area_16 = Area(Geometry=bbox_10.Box)  # -> Area, Centroid

# ---- group: 正常和阳角 - BoundingBox — 测Intersection (continued)
entwine_19 = Entwine(Branch00=move_52.Geometry, Branch01=area_16.Centroid, FlattenInputs=True)
flip_8 = FlipMatrix(Data=entwine_19)
item_75 = ListItem(List=flip_8, Index="0", Wrap=True)  # -> flatten(Item)
item_76 = ListItem(List=flip_8, Index="-1", Wrap=True)  # -> flatten(Item)
pull_45 = PullPoint(Point=item_76, Geometry=item_66.Item, ClosestOnly=True)  # -> flatten(ClosestPoint), Distance
pull_46 = PullPoint(Point=item_76, Geometry=item_66.Item1, ClosestOnly=True)  # -> flatten(ClosestPoint), Distance
vec2pt_5 = Vector2Pt(PointA=item_76, PointB=pull_45.ClosestPoint, Unitize=False)  # -> Vector, Length
vec2pt_6 = Vector2Pt(PointA=item_76, PointB=pull_46.ClosestPoint, Unitize=False)  # -> Vector, Length
multiplication_13 = Multiplication(A=vec2pt_5.Vector, B=vec2pt_6.Vector)
larger_14 = LargerThan(FirstNumber=multiplication_13, SecondNumber=0)  # -> LargerThan, OrEqualTo
dispatch_48 = Dispatch(List=item_75, DispatchPattern=larger_14.LargerThan)  # -> ListA, ListB

# ---- group: Normal
geo_7 = Geometry(cull_i_23)

# ---- group: Normal-Move
移动 = Geometry(dispatch_48.ListA)

# ----
# PLAN Results
merge_23 = Merge(Data1=geo_7, Data2=阳角, Data3=移动, Data4=阴角)

pln_28 = Plane(item_46)
number_slider_36 = Slider(3584, range=0..10000)
deplane_40 = DeconstructPlane(Plane=pln_28)  # -> Origin, XAxis, YAxis, ZAxis
amp_39 = Amplitude(Vector=deplane_40.YAxis, Amplitude=number_slider_36)
amp_40 = Amplitude(Vector=deplane_40.YAxis, Amplitude=expr("-x", number_slider_36))
boundary_5 = BoundarySurfaces(Edges=[offset_14, offset_13])
crv_68 = Curve(crv_28)
move_53 = Move(Geometry=deplane_40.Origin, Motion=amp_40)  # -> Geometry, Transform
move_54 = Move(Geometry=deplane_40.Origin, Motion=amp_39)  # -> Geometry, Transform
scx_2 = SurfaceCurve(Surface=boundary_5, Curve=crv_68)  # -> flatten(Curves), Points, UVPoints, Normals, Parameters, Tangents
ln_60 = Line(StartPoint=move_53.Geometry, EndPoint=move_54.Geometry)
ccx_36 = CurveCurve(CurveA=graft(ln_60), CurveB=scx_2.Curves)  # -> simplify(flatten(Points)), ParamsA, ParamsB

cullduppoints_8 = RemoveDuplicatePoints(InputPoints=ccx_36.Points, Tolerance=0.001)  # -> OutputPoints, FirstPointIndexes

pull_47 = PullPoint(Point=deplane_40.Origin, Geometry=graft(cullduppoints_8.OutputPoints), ClosestOnly=True)  # -> ClosestPoint, Distance
sort_31 = SortList(Keys=pull_47.Distance, ValuesA=pull_47.ClosestPoint)  # -> Keys, ValuesA
sort_32 = SortList(Keys=pull_47.Distance, ValuesA=pln_28)  # -> Keys, ValuesA
item_77 = ListItem(List=sort_32.ValuesA, Index=0, Wrap=True)  # -> flatten(Item)
item_78 = ListItem(List=sort_31.ValuesA, Index=0, Wrap=True)  # -> flatten(Item)
check_same_points_12 = CheckSamePoints(archPoint=pln_28, crvPoint=item_77)  # -> out, specialPt; inputs archPoint: list of Point3d, crvPoint: list of Point3d; same code as testpoint
item_79 = ListItem(List=pln_28, Index=check_same_points_12.specialPt, Wrap=True)
pull_48 = PullPoint(Point=item_79, Geometry=flatten(item_78), ClosestOnly=True)  # -> ClosestPoint, Distance
deplane_41 = DeconstructPlane(Plane=item_79)  # -> Origin, XAxis, YAxis, ZAxis

# ----
# 3.2下层建筑内侧到300到外侧50内
# 无钢结构
# 要求主体结构提供钢结构梁，默认位置为建筑边线向内300mm
number_slider_37 = Slider(300, range=0..1000)
cull_i_24 = CullIndex(List=pln_28, Indices=check_same_points_12.specialPt, Wrap=True)
crv_69 = Curve(crv_39)
offset_22 = OffsetCurve(Curve=crv_69, Distance=expr("-x", number_slider_37), Corners=1)
pull_49 = PullPoint(Point=cull_i_24, Geometry=offset_22, ClosestOnly=True)  # -> ClosestPoint, Distance
sort_33 = SortList(Keys=pull_49.Distance)  # -> Keys, ValuesA
larger_15 = LargerThan(FirstNumber=pull_49.Distance, SecondNumber=Slider(400, range=0..1000))  # -> LargerThan, OrEqualTo
dispatch_49 = Dispatch(List=cull_i_24, DispatchPattern=larger_15.LargerThan)  # -> ListA, ListB
panel_54 = Panel(sort_33.Keys)
pln_29 = Plane(dispatch_49.ListB)
number_slider_38 = Slider(3584, range=0..10000)
deplane_42 = DeconstructPlane(Plane=pln_29)  # -> Origin, XAxis, YAxis, ZAxis
amp_41 = Amplitude(Vector=deplane_42.YAxis, Amplitude=number_slider_38)
amp_42 = Amplitude(Vector=deplane_42.YAxis, Amplitude=expr("-x", number_slider_38))
move_55 = Move(Geometry=deplane_42.Origin, Motion=amp_42)  # -> Geometry, Transform
move_56 = Move(Geometry=deplane_42.Origin, Motion=amp_41)  # -> Geometry, Transform
ln_61 = Line(StartPoint=move_55.Geometry, EndPoint=move_56.Geometry)
ccx_37 = CurveCurve(CurveA=ln_61, CurveB=offset_22)  # -> flatten(Points), ParamsA, ParamsB
pull_50 = PullPoint(Point=deplane_42.Origin, Geometry=ccx_37.Points, ClosestOnly=True)  # -> ClosestPoint, Distance

# ----
# 3.1下层建筑内侧到300到外侧50内
# 底埋，钢板焊
move2pt_24 = MoveToPoint(Geometry=item_79, PointA=deplane_41.Origin, PointB=pull_48.ClosestPoint)  # -> Moved, Vector, Transform

# ----
# 3.2默认位置为建筑边线向内300mm
# 侧埋，钢板焊
# 03：钢板焊埋件[钢梁外侧]@钢边梁宽@钢边梁高
move2pt_25 = MoveToPoint(Geometry=pln_29, PointA=deplane_42.Origin, PointB=pull_50.ClosestPoint)  # -> Moved, Vector, Transform

# ----
# 做吊顶，不处理？？
pln_30 = Plane(dispatch_49.ListA)

# ==== cluster Cluster
G = ClusterInput()
rotate = Rotate(Geometry=G, Angle=3.141592654, Plane=PlaneXY(0, 0, 0))  # -> Geometry, Transform
boxprop = BoxProperties(Box=rotate.Geometry)  # -> Center, Diagonal, Area, Volume, Degeneracy
bbox = BoundingBox(Content=rotate.Geometry, Plane=PlaneXY(0, 0, 0))  # -> Box, Box_2
debox = DeconstructBox(Box=bbox.Box)  # -> Plane, X, Y, Z
pdecon = Deconstruct(Point=boxprop.Center)  # -> XComponent, YComponent, ZComponent
dedomain = DeconstructDomain(Domain=debox.Y)  # -> Start, End
pt = ConstructPoint(XCoordinate=pdecon.XComponent, YCoordinate=dedomain.Start, ZCoordinate=pdecon.ZComponent)
xy = XYPlane(Origin=Point(0, 0, 0))
pl_origin = PlaneOrigin(Base=xy, Origin=pt)
orient = Orient(Geometry=rotate.Geometry, Source=pl_origin, Target=xy)  # -> Geometry, Transform
G_2 = ClusterOutput(orient.Geometry)
